# Grasshopper definition abb_irb_6700_rrc_motion_planning_studio_weinand.gh (Grasshopper 1.0.7)

number_slider = Slider(3500, range=0..10000)
info = Info()  # -> info
#   port info: Environment info.
# ---------- info: Python ----------
"""
Displays information about the active COMPAS environment.
"""
import compas_bootstrapper
from ghpythonlib.componentbase import executingcomponent as component

import compas
import compas_fab


class CompasInfo(component):
    def RunScript(self):
        self.Message = 'COMPAS v{}'.format(compas.__version__)
        info = 'COMPAS Version: {}\nEnvironment: {}\nCOMPAS FAB Version:{}'
        return (info.format(compas.__version__, compas_bootstrapper.ENVIRONMENT_NAME,compas_fab.__version__))
# ---------- end info ----------

# ----
# Load Robot
connect = BooleanToggle(True)
ros_connect = ROSConnect(connect=connect)  # -> ros_client, is_connected; inputs port: Int32, connect: Boolean
#   port ip: The ip address ROS. Defaults to 127.0.0.1.
#   port port: The port of ROS. Defaults to 9090.
#   port connect: If True, connects to ROS. If False, disconnects from ROS. Defaults to False.
#   port ros_client: The ROS client.
#   port is_connected: True if connection established.
# ---------- ros_connect: Python ----------
"""
Connect or disconnect to ROS.

COMPAS FAB v0.27.0
"""
from ghpythonlib.componentbase import executingcomponent as component
from scriptcontext import sticky as st

from compas_fab.backends import RosClient
from compas_fab.ghpython.components import create_id


class ROSConnect(component):
    def RunScript(self, ip, port, connect):
        ros_client = None

        ip = ip or '127.0.0.1'
        port = port or 9090

        key = create_id(self, 'ros_client')
        ros_client = st.get(key, None)

        if ros_client:
            st[key].close()
        if connect:
            st[key] = RosClient(ip, port)
            st[key].run(5)

        ros_client = st.get(key, None)
        is_connected = ros_client.is_connected if ros_client else False
        return (ros_client, is_connected)
# ---------- end ros_connect ----------
load_robot = BooleanToggle(True)
# Package Version: {0}
# 0. COMPAS Version: 1.15.1
# Environment: fs2022
# COMPAS FAB Version:0.24.0
ros_robot = ROSRobot(ros_client=ros_connect.ros_client, load=load_robot)  # -> robot; inputs load: Boolean
#   port ros_client: The ROS client.
#   port load: If True, loads the robot from ROS. Defaults to False.
# ---------- ros_robot: Python ----------
"""
Load robot directly from ROS.

COMPAS FAB v0.27.0
"""
from compas_ghpython.artists import RobotModelArtist
from ghpythonlib.componentbase import executingcomponent as component
from scriptcontext import sticky as st

from compas_fab.ghpython.components import create_id


class ROSRobot(component):
    def RunScript(self, ros_client, load):
        key = create_id(self, 'robot')

        if ros_client and ros_client.is_connected and load:
            # Load URDF from ROS
            st[key] = ros_client.load_robot(load_geometry=True, precision='12f')
            st[key].artist = RobotModelArtist(st[key].model)

        robot = st.get(key, None)
        if robot:  # client sometimes need to be restarted, without needing to reload geometry
            robot.client = ros_client
        return robot
# ---------- end ros_robot ----------

# ----
# Plane list
number_slider_2 = Slider(0, range=0..5)  # disabled
crv = Curve([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])  # disabled
list_item = ListItem(List=crv, Index=number_slider_2, Wrap=True)  # -> Item, Item1; disabled
plane = Plane(list_item.Item1)  # disabled
plane_2 = Plane(list_item.Item)  # disabled

# ----
# ABB IRB6700 - 02162023
# Author: Jingwen Wang
# Email: jingwen.wang@epfl.ch
# Package Version: COMPAS Version: 1.17.4
# COMPAS FAB Version:0.27.0
your_version = Panel(info)
number_slider_3 = Slider(0.1, range=0..1)  # disabled
toggle = BooleanToggle(False)
brep = Brep(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)

# ----
# Attach Tool
number_slider_4 = Slider(0.2, range=0..1)
construct_point = ConstructPoint(XCoordinate=0, YCoordinate=0, ZCoordinate=number_slider_4)
xy_plane = XYPlane(Origin=construct_point)
attached_tool = AttachedTool(robot=ros_robot, visual_mesh=brep, tcf_plane=xy_plane)  # -> robot; inputs visual_mesh: Mesh, collision_mesh: Mesh
#   port visual_mesh: A visual mesh for the tool.
#   port collision_mesh: A collision mesh for the tool.
#   port tcf_plane: The frame of the tool in tool0 frame.
#   port group: The planning group to which the tool should be attached.
# ---------- attached_tool: Python ----------
"""
Attach a tool to the robot.

COMPAS FAB v0.27.0
"""
from ghpythonlib.componentbase import executingcomponent as component
from compas_rhino.conversions import RhinoMesh
from compas_rhino.conversions import plane_to_compas_frame

from compas.geometry import Frame
from compas_fab.robots import Tool


class AttachToolComponent(component):
    def RunScript(self, robot, visual_mesh, collision_mesh, tcf_plane, group):
        if robot and robot.client and robot.client.is_connected and visual_mesh:
            if not collision_mesh:
                collision_mesh = visual_mesh

            c_visual_mesh = RhinoMesh.from_geometry(visual_mesh).to_compas()
            c_collision_mesh = RhinoMesh.from_geometry(collision_mesh).to_compas()

            if not tcf_plane:
                frame = Frame.worldXY()
            else:
                frame = plane_to_compas_frame(tcf_plane)
            tool = Tool(c_visual_mesh, frame, c_collision_mesh)

            robot.attach_tool(tool, group)

        return robot
# ---------- end attached_tool ----------

# ----
# Test Linear Axis with Move Joint
a4 = Slider(161, range=-360..360)  # disabled
a5 = Slider(-27, range=-360..360)  # disabled
a1 = Slider(300, range=0..360)  # disabled
a2 = Slider(8, range=-360..360)  # disabled
a3 = Slider(-110, range=-360..360)  # disabled
a6 = Slider(-35, range=-360..360)  # disabled
a7 = Slider(-35, range=-360..360)  # disabled
config = PythonScript(vals=[a1, a2, a3, a4, a5, a6, a7])  # -> config; inputs vals: list; disabled
# ---------- config: Python ----------
import math
from compas.robots import Configuration

config = Configuration.from_revolute_values([math.radians(a) for a in vals])
print config
# ---------- end config ----------
panel = Panel("manipulator")  # disabled
inverse_kinematics = InverseKinematics(robot=attached_tool, plane=plane, start_configuration=config, group=panel)  # -> configuration; disabled
#   port plane: The plane or frame to calculate the inverse kinematic for.
#   port start_configuration: If passed, calculates the inverse such that the joint positions differ the least from the start_configuration. Defaults to the zero configuration.
#   port group: The planning group used for calculation. Defaults to the robot's main planning group.
#   port configuration: The planning group's configuration.
# ---------- inverse_kinematics: Python ----------
"""
Calculate the robot's inverse kinematic for a given plane.

COMPAS FAB v0.24.0
"""
from ghpythonlib.componentbase import executingcomponent as component
from compas.geometry import Frame
#Frame([0, 0, 0], [1, 0, 0], [0, 1, 0])
#from compas_fab.ghpython.components import 


class InverseKinematics(component):
    def RunScript(self, robot, plane, start_configuration, group):
        configuration = None
        if robot and robot.client and robot.client.is_connected and plane:
            frame = Frame([plane.Origin.X,plane.Origin.Y,plane.Origin.Z], [plane.XAxis.X,plane.XAxis.Y,plane.XAxis.Z], [plane.YAxis.X,plane.YAxis.Y,plane.YAxis.Z])
            #frame = coerce_frame(plane)
            configuration = robot.inverse_kinematics(frame, start_configuration, group)
        return configuration
# ---------- end inverse_kinematics ----------
config_2 = PythonScript(val0=a1, configuration=inverse_kinematics)  # -> config; disabled
# ---------- config_2: Python ----------
import math
from compas.robots import Configuration

combo = []
combo.append(math.radians(val0))
combo.extend(configuration.joint_values)
config = Configuration.from_revolute_values(combo)

print config
# ---------- end config_2 ----------

# ----
# Test Linear Axis with Move Joint
a1_2 = Slider(250, range=0..360)  # disabled
a2_2 = Slider(0, range=-360..360)  # disabled
a3_2 = Slider(0, range=-360..360)  # disabled
a4_2 = Slider(0, range=-360..360)  # disabled
a5_2 = Slider(0, range=-360..360)  # disabled
a6_2 = Slider(0, range=-360..360)  # disabled
a7_2 = Slider(0, range=-360..360)  # disabled
config_3 = PythonScript(vals=[a1_2, a2_2, a3_2, a4_2, a5_2, a6_2, a7_2])  # -> config; inputs vals: list; disabled; same code as config
panel_2 = Panel("manipulator")  # disabled
inverse_kinematics_2 = InverseKinematics(robot=attached_tool, plane=plane_2, start_configuration=config_3, group=panel_2)  # -> configuration; disabled; same code as inverse_kinematics
config_4 = PythonScript(val0=a1_2, configuration=inverse_kinematics_2)  # -> config; disabled; same code as config_2

# ----
# FK
merge = Merge(
    Data1=number_slider,
    Data2=Slider(-26.124, range=-360..360),
    Data3=Slider(11.2, range=-360..360),
    Data4=Slider(4.868, range=-360..360),
    Data5=Slider(-95.576, range=-360..360),
    Data6=Slider(-25.432, range=-360..360),
    Data7=Slider(-22.99, range=-360..360))
config_5 = PythonScript(robot=attached_tool, val_track=number_slider, vals=merge)  # -> config, plane; inputs vals: list
# ---------- config_5: Python ----------
import math
from compas.robots import Configuration



config = Configuration.from_revolute_values([math.radians(a) for a in vals])
config.joint_values[0] = val_track/1000
print config

frame = robot.forward_kinematics(config,options=dict(solver="model"))
plane = [frame.point.x*1000,frame.point.y*1000,frame.point.z*1000]
# ---------- end config_5 ----------

# ----
# Visualize Robot
toggle_2 = BooleanToggle(True)
robot_visualize = RobotVisualize(robot=attached_tool, configuration=config_5.config, show_end_effector_frame=toggle_2)  # -> visual, collision, attached_meshes, frames, base_frame, ee_frame; inputs attached_collision_meshes: list, show_visual: Boolean, show_collision: Boolean, show_frames: Boolean, show_base_frame: Boolean, show_end_effector_frame: Boolean, show_acm: Boolean
#   port group: The planning group used for end-effector and base visualization.
#   port configuration: The robot's full configuration.
#   port attached_collision_meshes: A list of attached collision meshes.
#   port show_visual: Whether or not to show the robot's visual meshes.
#   port show_collision: Whether or not to show the robot's collision meshes.
#   port show_frames: Whether or not to show the robot's joint frames.
#   port show_base_frame: Whether or not to show the robot's base frame.
#   port show_end_effector_frame: Whether or not to show the robot's end-effector frame.
#   port show_acm: Whether or not to show the attached collision meshes (if any).
#   port visual: The robot's visual Rhino meshes (if any).
#   port collision: The robot's collision Rhino meshes (if any).
#   port attached_meshes: The attached collision Rhino meshes (if any).
#   port frames: The robot's joint frames as Rhino planes (if any).
#   port base_frame: The robot's base frame as a Rhino plane (if any).
#   port ee_frame: The robot's end-effector frame as a Rhino plane (if any).
# ---------- robot_visualize: Python ----------
"""
Visualizes the robot.

COMPAS FAB v0.24.0
"""
from compas.geometry import Frame
from compas.geometry import Transformation
from compas_ghpython.artists import FrameArtist
from compas_ghpython.artists import MeshArtist
from ghpythonlib.componentbase import executingcomponent as component


class RobotVisualize(component):
    def RunScript(self, robot, group, configuration, attached_collision_meshes, show_visual, show_collision,
                  show_frames, show_base_frame, show_end_effector_frame, show_acm):

        visual = None
        collision = None
        attached_meshes = None
        frames = None
        base_frame = None
        ee_frame = None

        if robot:
            show_visual = True if show_visual is None else show_visual
            configuration = configuration or robot.zero_configuration()

            robot.update(configuration, visual=show_visual, collision=show_collision)
            compas_frames = robot.transformed_frames(configuration, group)

            if show_visual:
                visual = robot.artist.draw_visual()

            if show_collision:
                collision = robot.artist.draw_collision()

            if show_base_frame:
                base_compas_frame = compas_frames[0]
                artist = FrameArtist(base_compas_frame)
                base_frame = artist.draw()

            if show_end_effector_frame:
                ee_compas_frame = robot.forward_kinematics(configuration, group, options=dict(solver='model'))
                artist = FrameArtist(ee_compas_frame)
                ee_frame = artist.draw()

            if show_frames:
                frames = []
                for compas_frame in compas_frames[1:]:
                    artist = FrameArtist(compas_frame)
                    frame = artist.draw()
                    frames.append(frame)

            if show_acm:
                attached_meshes = []
                for acm in attached_collision_meshes:
                    frame = robot.forward_kinematics(configuration, options=dict(solver='model', link_name=acm.link_name))
                    T = Transformation.from_frame_to_frame(Frame.worldXY(), frame)
                    mesh = acm.collision_mesh.mesh.transformed(T)
                    attached_meshes.append(MeshArtist(mesh).draw())

        return (visual, collision, attached_meshes, frames, base_frame, ee_frame)
# ---------- end robot_visualize ----------

# ----
# Send configurations as a list of values to the controller
number_slider_5 = Slider(1000, range=0..1000)
ros_client = Data(ros_connect.ros_client)
python = GhPythonScript(config=config_5.config, ros=ros_client, run=Button(), speed=number_slider_5)  # -> out, a; inputs config: list
# ---------- python: Python ----------
import compas_rrc as rrc
import compas
import math
from compas.geometry import Frame, Translation
abb = rrc.AbbClient(ros, '/rob1')
print('Connected.')

if run : 

    # Get joints
    robot_joints, external_axes = abb.send_and_wait(rrc.GetJoints())
    
    # Print received values
    print(robot_joints, external_axes)
    
    for i in range(0, len(config)):
        # Change value and move to new position
        print(config[i].data)
        
        robot_joints_updated = [
            math.degrees(config[i].joint_values[1]),
            math.degrees(config[i].joint_values[2]),
            math.degrees(config[i].joint_values[3]),
            math.degrees(config[i].joint_values[4]),
            math.degrees(config[i].joint_values[5]),
            math.degrees(config[i].joint_values[6])
        ]
        external_axes_updated = [
            config[i].joint_values[0]*1000
        ]
        print(external_axes_updated)
        
        #frame = abb.send_and_wait(rrc.GetFrame())
        # T = Translation.from_vector([50,0,0])
        #frame[0].x = 1576
        #frame[0].y = 2407
        #frame[0].z = 1367
        #abb.send_and_wait(rrc.MoveToFrame(frame, speed, rrc.Zone.FINE, rrc.Motion.LINEAR), timeout = 10)
        
        #print(math.degrees(config.joint_values[1]))
        
        #robot_joints_updated = rrc.RobotJoints.from_configuration(config_)
        #external_axes_updated = [math.degrees(config.joint_values[0])]
        done = abb.send(rrc.MoveToJoints(robot_joints_updated, external_axes_updated, speed, rrc.Zone.FINE))
# ---------- end python ----------

# ----
# Joint Move
constraints_from_target_configuration = ConstraintsFromTargetConfiguration(robot=attached_tool, target_configuration=config_2)  # -> constraints; disabled
#   port target_configuration: The target configuration.
#   port tolerance_above: The tolerances above the targeted joint value of each configurable joint, defining the upper bound in radians/meters to be achieved.
#   port tolerance_below: The tolerances below the targeted joint value of each configurable joint, defining the lower bound in radians/meters to be achieved.
#   port group: The planning group for which we specify the constraint. Defaults to the robot's main planning group.
#   port constraints: A list joint constraints in radians/meters.
# ---------- constraints_from_target_configuration: Python ----------
"""
Create joint constraints for each of the robot's configurable joints based on a given target configuration.

COMPAS FAB v0.27.0
"""
import math

from ghpythonlib.componentbase import executingcomponent as component


class ConstraintsFromTargetConfiguration(component):

    DEFAULT_TOLERANCE_METERS = .001
    DEFAULT_TOLERANCE_RADIANS = math.radians(1)

    def RunScript(self, robot, target_configuration, tolerance_above, tolerance_below, group):
        if robot and target_configuration:
            tolerance_above = tolerance_above or self._generate_default_tolerances(robot.get_configurable_joints(group))
            tolerance_below = tolerance_below or self._generate_default_tolerances(robot.get_configurable_joints(group))

            constraints = robot.constraints_from_configuration(
                configuration=target_configuration,
                tolerances_above=tolerance_above,
                tolerances_below=tolerance_below,
                group=group
            )

            return constraints

    def _generate_default_tolerances(self, joints):
        return [
            self.DEFAULT_TOLERANCE_METERS if j.is_scalable()
            else self.DEFAULT_TOLERANCE_RADIANS
            for j in joints
        ]
# ---------- end constraints_from_target_configuration ----------
toggle_3 = BooleanToggle(True)  # disabled
plan_motion = PlanMotion(
    robot=attached_tool,
    goal_constraints=constraints_from_target_configuration,
    start_configuration=config_4,
    compute=toggle_3)  # -> trajectory; inputs goal_constraints: list, attached_collision_meshes: list, path_constraints: list, compute: Boolean; disabled
#   port goal_constraints: The goal to be achieved, defined in a set of constraints. Constraints can be very specific, for example defining value domains for each joint, such that the goal configuration is included, or defining a volume in space, to which a specific robot link (e.g. the end-effector) is required to move to.
#   port start_configuration: The robot's full configuration, i.e. values for all configurable joints of the entire robot, at the starting position. Defaults to the all-zero configuration.
#   port group: The planning group used for calculation. Defaults to the robot's main planning group.
#   port attached_collision_meshes: A list of attached collision meshes to be included for planning.
#   port path_constraints: Optional constraints that can be imposed along the solution path. Note that path calculation won't work if the start_configuration violates these constraints. Defaults to None.
#   port planner_id: The name of the algorithm used for path planning. Defaults to 'RRTConnect'
#   port compute: If True, calculates a trajectory.
#   port trajectory: The calculated trajectory.
# ---------- plan_motion: Python ----------
"""
Calculate a motion path.

COMPAS FAB v0.27.0
"""
from ghpythonlib.componentbase import executingcomponent as component
from scriptcontext import sticky as st

from compas_fab.ghpython.components import create_id


class PlanMotion(component):
    def RunScript(self, robot, goal_constraints, start_configuration, group, attached_collision_meshes, path_constraints, planner_id, compute):

        key = create_id(self, 'trajectory')

        path_constraints = list(path_constraints) if path_constraints else None
        attached_collision_meshes = list(attached_collision_meshes) if attached_collision_meshes else None
        planner_id = str(planner_id) if planner_id else 'RRTConnect'

        if robot and robot.client and robot.client.is_connected and start_configuration and goal_constraints and compute:
            st[key] = robot.plan_motion(goal_constraints,
                                        start_configuration=start_configuration,
                                        group=group,
                                        options=dict(
                                            attached_collision_meshes=attached_collision_meshes,
                                            path_constraints=path_constraints,
                                            planner_id=planner_id,
                                        ))

        trajectory = st.get(key, None)
        return trajectory
# ---------- end plan_motion ----------
trajectory_visualize = TrajectoryVisualize(robot=attached_tool, trajectory=plan_motion)  # -> start_configuration, configurations, fraction, time, planes, P, V, A; disabled
#   port group: The planning group for which this trajectory was planned.
#   port trajectory: The calculated trajectory.
#   port start_configuration: The start configuration of the trajectory.
#   port configurations: The full configurations along the trajectory.
#   port fraction: Indicates the fraction of requested trajectory that was calculated, e.g. 1 means the full trajectory was found.
#   port time: The time which is needed to execute that trajectory at full speed.
#   port planes: The planes of the robot's end-effector.
#   port P: The positions along the trajectory
#   port V: The velocities along the trajectory
#   port A: The accelerations along the trajectory
# ---------- trajectory_visualize: Python ----------
"""
Visualizes a trajectory.

COMPAS FAB v0.27.0
"""
from compas_ghpython import draw_frame
from compas_ghpython import list_to_ghtree
from ghpythonlib.componentbase import executingcomponent as component


class TrajectoryVisualize(component):
    def RunScript(self, robot, group, trajectory):
        start_configuration = None
        configurations = []
        fraction = 0.
        time = 0.

        planes = []
        positions = []
        velocities = []
        accelerations = []

        if robot and trajectory:
            group = group or robot.main_group_name

            for c in trajectory.points:
                configurations.append(robot.merge_group_with_full_configuration(c, trajectory.start_configuration, group))
                frame = robot.forward_kinematics(c, group, options=dict(solver='model'))
                planes.append(draw_frame(frame))
                positions.append(c.positions)
                velocities.append(c.velocities)
                accelerations.append(c.accelerations)

            start_configuration = trajectory.start_configuration
            fraction = trajectory.fraction
            time = trajectory.time_from_start

        P = list_to_ghtree(list(zip(*positions)))
        V = list_to_ghtree(list(zip(*velocities)))
        A = list_to_ghtree(list(zip(*accelerations)))

        # return outputs if you have them; here I try it for you:
        return (start_configuration, configurations, fraction, time, planes, P, V, A)
# ---------- end trajectory_visualize ----------
number_slider_6 = Slider(19, range=0..20)  # disabled
list_item_2 = ListItem(List=trajectory_visualize.configurations, Index=number_slider_6, Wrap=True)  # disabled

# ----
# Linear Move
plan_cartesian_motion = PlanCartesianMotion(robot=attached_tool, planes=[plane_2, plane], start_configuration=config_4, max_step=number_slider_3, compute=toggle_3)  # -> trajectory; inputs planes: list, attached_collision_meshes: list, path_constraints: list, compute: Boolean; disabled
#   port planes: The planes or frames through which the path is defined.
#   port start_configuration: The robot's full configuration, i.e. values for all configurable joints of the entire robot, at the starting position. Defaults to the all-zero configuration.
#   port group: The planning group used for calculation. Defaults to the robot's main planning group.
#   port attached_collision_meshes: A list of attached collision meshes to be included for planning.
#   port path_constraints: Optional constraints that can be imposed along the solution path. Note that path calculation won't work if the start_configuration violates these constraints. Defaults to None.
#   port max_step: The approximate distance between the calculated points. (Defined in the robot's units.) Defaults to 0.01.
#   port compute: If True, calculates a trajectory.
#   port trajectory: The calculated trajectory.
# ---------- plan_cartesian_motion: Python ----------
"""
Calculate a cartesian motion path (linear in tool space).

COMPAS FAB v0.27.0
"""
from compas_rhino.conversions import RhinoPlane
from ghpythonlib.componentbase import executingcomponent as component
from scriptcontext import sticky as st

from compas_fab.ghpython.components import create_id


class PlanCartesianMotion(component):
    def RunScript(self, robot, planes, start_configuration, group, attached_collision_meshes, path_constraints, max_step, compute):

        key = create_id(self, 'trajectory')

        max_step = float(max_step) if max_step else 0.01
        path_constraints = list(path_constraints) if path_constraints else None
        attached_collision_meshes = list(attached_collision_meshes) if attached_collision_meshes else None

        if robot and robot.client and robot.client.is_connected and start_configuration and planes and compute:
            frames = [RhinoPlane.from_geometry(plane).to_compas_frame() for plane in planes]
            st[key] = robot.plan_cartesian_motion(frames,
                                                  start_configuration=start_configuration,
                                                  group=group,
                                                  options=dict(
                                                      max_step=max_step,
                                                      path_constraints=path_constraints,
                                                      attached_collision_meshes=attached_collision_meshes
                                                  ))

        trajectory = st.get(key, None)
        return trajectory
# ---------- end plan_cartesian_motion ----------
trajectory_visualize_2 = TrajectoryVisualize(robot=attached_tool, trajectory=plan_cartesian_motion)  # -> start_configuration, configurations, fraction, time, planes, P, V, A; disabled; same code as trajectory_visualize
number_slider_7 = Slider(29, range=0..133)  # disabled
list_item_3 = ListItem(List=trajectory_visualize_2.configurations, Index=number_slider_7, Wrap=True)  # disabled

ghpython_script = GhPythonScript(gripper=Toggle(True), ros=ros_client)  # -> out, a
# ---------- ghpython_script: Python ----------
__author__ = "rogeau"
__version__ = "2023.04.28"

import rhinoscriptsyntax as rs

import compas_rrc as rrc

if gripper is True:
    abb = rrc.AbbClient(ros, '/rob1')
    print('light_in')
    abb.send_and_wait(rrc.SetDigital('Local_IO_0_DO1', 1), timeout=5)
    abb.send_and_wait(rrc.WaitTime(1))
    print('light')
if gripper is False:
    abb = rrc.AbbClient(ros, '/rob1')
    print('light_in')
    abb.send_and_wait(rrc.SetDigital('Local_IO_0_DO1', 0), timeout=5)
    abb.send_and_wait(rrc.WaitTime(1))
    print('light')
# ---------- end ghpython_script ----------

# ----
# Get Frame & Send Frame
button = Button()
ros_client_2 = Data(ros_connect.ros_client)
python_2 = GhPythonScript(ros=ros_client_2, run=button, speed=Slider(100, range=0..300))
# ---------- python_2: Python ----------
import compas_rrc as rrc
from compas.geometry import Frame, Translation
abb = rrc.AbbClient(ros, '/rob1')
print('Connected.')

if run : 

    frame = abb.send_and_wait(rrc.GetFrame())
    T = Translation.from_vector([50,0,0])
    frame = frame.transformed(T)
    abb.send_and_wait(rrc.MoveToFrame(frame, speed, rrc.Zone.FINE, rrc.Motion.LINEAR), timeout = 10)
# ---------- end python_2 ----------

# ----
# Visualize Robot
toggle_4 = BooleanToggle(True)  # disabled
robot_visualize_2 = RobotVisualize(robot=attached_tool, configuration=list_item_3, show_end_effector_frame=toggle_4)  # -> visual, collision, attached_meshes, frames, base_frame, ee_frame; inputs attached_collision_meshes: list, show_visual: Boolean, show_collision: Boolean, show_frames: Boolean, show_base_frame: Boolean, show_end_effector_frame: Boolean, show_acm: Boolean; disabled; same code as robot_visualize

# ----
# Get Joint & Send Joint
number_slider_8 = Slider(100, range=0..300)
ros_client_3 = Data(ros_connect.ros_client)
python_3 = GhPythonScript(ros=ros_client_3, run=Button(), speed=number_slider_8)
# ---------- python_3: Python ----------
import compas_rrc as rrc
from compas.geometry import Frame, Translation
abb = rrc.AbbClient(ros, '/rob1')
print('Connected.')

if run : 

    # Get joints
    robot_joints, external_axes = abb.send_and_wait(rrc.GetJoints())
    
    # Print received values
    print(robot_joints, external_axes)
    
    # Change value and move to new position
    robot_joints.rax_1 += 15
    speed = 100 # Unit [mm/s]
    done = abb.send_and_wait(rrc.MoveToJoints(robot_joints, external_axes, speed, rrc.Zone.FINE))
# ---------- end python_3 ----------

# ----
# Get Robtarget & Send Robtarget
number_slider_9 = Slider(100, range=0..300)
ros_client_4 = Data(ros_connect.ros_client)
python_4 = GhPythonScript(ros=ros_client_4, run=Button(), speed=number_slider_9)
# ---------- python_4: Python ----------
import compas_rrc as rrc
from compas.geometry import Frame, Translation
abb = rrc.AbbClient(ros, '/rob1')
print('Connected.')

if run : 

    # Get frame and external axes
    frame, external_axes = abb.send_and_wait(rrc.GetRobtarget())
    
    # Print received values
    print(frame, external_axes)
    
    # Change any value and move to new position
    frame.point[0] += 50
    done = abb.send_and_wait(rrc.MoveToRobtarget(frame, external_axes, speed, rrc.Zone.FINE))
# ---------- end python_4 ----------

# ----
# Send configurations as a list of values to the controller
number_slider_10 = Slider(1000, range=0..1000)
ros_client_5 = Data(ros_connect.ros_client)
python_5 = GhPythonScript(config=config_5.config, ros=ros_client_5, run=Button(), speed=number_slider_10)  # -> out, a; inputs config: list; same code as python

toggle_5 = BooleanToggle(False)
panel_3 = Panel(python_5.out)
