# Grasshopper definition abb_irb_6700_rrc_motion_planning_studio_weinand_2023_05_01.gh (Grasshopper 1.0.7)

# ----
# YOUR CODE
number_slider = Slider(50, range=0..100)
number_slider_2 = Slider(10, range=0..20)
surface_to_contour = Brep(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)
repeat = RepeatData(Data=Slider(0.108, range=0..1), Length=number_slider)
contour = ContourEx(Shape=surface_to_contour, Plane=PlaneXY(0, 0, 0), Distances=repeat)
number_slider_3 = Slider(1, range=0..1)
divide = DivideCurve(Curve=contour, Count=number_slider_2, Kinks=False)  # -> flatten(Points), flatten(Tangents), Parameters
multiplication = Multiplication(A=number_slider_2, B=0.5)
subtraction = Subtraction(A=multiplication, B=number_slider_3)
addition = Addition(A=multiplication, B=number_slider_3)
cull = CullPattern(List=divide.Points, CullPattern=[False, True])
cull_2 = CullPattern(List=divide.Tangents, CullPattern=[False, True])
relay = Relay([multiplication, addition])
partition = PartitionList(List=cull, Size=relay)
partition_2 = PartitionList(List=cull_2, Size=relay)
Z = UnitZ(Factor=1)
xprod = CrossProduct(VectorA=partition_2, VectorB=Z, Unitize=False)  # -> Vector, Length
tstat = TreeStatistics(Tree=partition)  # -> Paths, Length, Count
repeat_2 = RepeatData(Data=[Slider(45, range=-90..90), Slider(-45, range=-90..90)], Length=tstat.Count)  # -> simplify(graft(Data))
pl = ConstructPlane(Origin=partition, XAxis=partition_2, YAxis=xprod.Vector)  # -> simplify(Plane)
prot = RotatePlane(Plane=pl, Angle=degrees(repeat_2))
object_to_orient = Brep(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)
orient = Orient(Geometry=object_to_orient, Source=PlaneXY(0, 0, 0), Target=prot)  # -> Geometry, Transform

info = Info()  # -> info
#   port info: Environment info.
# ---------- info: Python ----------
"""
Displays information about the active COMPAS environment.
"""
import compas_bootstrapper
from ghpythonlib.componentbase import executingcomponent as component

import compas
import compas_fab


class CompasInfo(component):
    def RunScript(self):
        self.Message = 'COMPAS v{}'.format(compas.__version__)
        info = 'COMPAS Version: {}\nEnvironment: {}\nCOMPAS FAB Version:{}'
        return (info.format(compas.__version__, compas_bootstrapper.ENVIRONMENT_NAME,compas_fab.__version__))
# ---------- end info ----------

# ----
# Load Robot
connect = BooleanToggle(True)
ros_connect = ROSConnect(connect=connect)  # -> ros_client, is_connected; inputs port: Int32, connect: Boolean
#   port ip: The ip address ROS. Defaults to 127.0.0.1.
#   port port: The port of ROS. Defaults to 9090.
#   port connect: If True, connects to ROS. If False, disconnects from ROS. Defaults to False.
#   port ros_client: The ROS client.
#   port is_connected: True if connection established.
# ---------- ros_connect: Python ----------
"""
Connect or disconnect to ROS.

COMPAS FAB v0.27.0
"""
from ghpythonlib.componentbase import executingcomponent as component
from scriptcontext import sticky as st

from compas_fab.backends import RosClient
from compas_fab.ghpython.components import create_id


class ROSConnect(component):
    def RunScript(self, ip, port, connect):
        ros_client = None

        ip = ip or '127.0.0.1'
        port = port or 9090

        key = create_id(self, 'ros_client')
        ros_client = st.get(key, None)

        if ros_client:
            st[key].close()
        if connect:
            st[key] = RosClient(ip, port)
            st[key].run(5)

        ros_client = st.get(key, None)
        is_connected = ros_client.is_connected if ros_client else False
        return (ros_client, is_connected)
# ---------- end ros_connect ----------
load_robot = BooleanToggle(True)
# Package Version: {0}
# 0. COMPAS Version: 1.15.1
# Environment: fs2022
# COMPAS FAB Version:0.24.0
ros_robot = ROSRobot(ros_client=ros_connect.ros_client, load=load_robot)  # -> robot; inputs load: Boolean
#   port ros_client: The ROS client.
#   port load: If True, loads the robot from ROS. Defaults to False.
# ---------- ros_robot: Python ----------
"""
Load robot directly from ROS.

COMPAS FAB v0.27.0
"""
from compas_ghpython.artists import RobotModelArtist
from ghpythonlib.componentbase import executingcomponent as component
from scriptcontext import sticky as st

from compas_fab.ghpython.components import create_id


class ROSRobot(component):
    def RunScript(self, ros_client, load):
        key = create_id(self, 'robot')

        if ros_client and ros_client.is_connected and load:
            # Load URDF from ROS
            st[key] = ros_client.load_robot(load_geometry=True, precision='12f')
            st[key].artist = RobotModelArtist(st[key].model)

        robot = st.get(key, None)
        if robot:  # client sometimes need to be restarted, without needing to reload geometry
            robot.client = ros_client
        return robot
# ---------- end ros_robot ----------

# ----
# Package Version: COMPAS Version: 1.17.4
# COMPAS FAB Version:0.27.0
your_version = Panel(info)

# ----
# Preview
number_slider_4 = Slider(9, range=0..100)
split = SplitList(List=flatten(orient.Geometry), Index=expr("x+1", number_slider_4))  # -> ListA, ListB
item = ListItem(List=flatten(split.ListA), Index=number_slider_4, Wrap=True)
item_2 = ListItem(List=flatten(prot), Index=number_slider_4, Wrap=True)
all_breps = Geometry(split.ListA)
current_brep = Geometry(item)
current_plane = Geometry(item_2)
preview = CustomPreview(Geometry=current_brep, Material=ColourSwatch(SwatchColor=RGB(255, 98, 0)))

target_plane = Plane(current_plane)

# ----
# Pick & Place Sequence
pick_plane = Curve(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)
Z_2 = UnitZ(Factor=1.5)
plane = Plane(pick_plane)
move = Move(Geometry=plane, Motion=Z_2)  # -> Geometry, Transform
project = Project(Geometry=target_plane, Plane=move.Geometry)  # -> Geometry, Transform

brep = Brep(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)

# ----
# Attach Tool
number_slider_5 = Slider(0.2, range=0..1)
construct_point = ConstructPoint(XCoordinate=0, YCoordinate=0, ZCoordinate=number_slider_5)
xy_plane = XYPlane(Origin=construct_point)
attached_tool = AttachedTool(robot=ros_robot, visual_mesh=brep, tcf_plane=xy_plane)  # -> robot; inputs visual_mesh: Mesh, collision_mesh: Mesh
#   port visual_mesh: A visual mesh for the tool.
#   port collision_mesh: A collision mesh for the tool.
#   port tcf_plane: The frame of the tool in tool0 frame.
#   port group: The planning group to which the tool should be attached.
# ---------- attached_tool: Python ----------
"""
Attach a tool to the robot.

COMPAS FAB v0.27.0
"""
from ghpythonlib.componentbase import executingcomponent as component
from compas_rhino.conversions import RhinoMesh
from compas_rhino.conversions import plane_to_compas_frame

from compas.geometry import Frame
from compas_fab.robots import Tool


class AttachToolComponent(component):
    def RunScript(self, robot, visual_mesh, collision_mesh, tcf_plane, group):
        if robot and robot.client and robot.client.is_connected and visual_mesh:
            if not collision_mesh:
                collision_mesh = visual_mesh

            c_visual_mesh = RhinoMesh.from_geometry(visual_mesh).to_compas()
            c_collision_mesh = RhinoMesh.from_geometry(collision_mesh).to_compas()

            if not tcf_plane:
                frame = Frame.worldXY()
            else:
                frame = plane_to_compas_frame(tcf_plane)
            tool = Tool(c_visual_mesh, frame, c_collision_mesh)

            robot.attach_tool(tool, group)

        return robot
# ---------- end attached_tool ----------

# ----
# FK
number_slider_6 = Slider(6700, range=0..6700)
merge = Merge(
    Data1=number_slider_6,
    Data2=Slider(-46.536, range=-360..360),
    Data3=Slider(11.2, range=-360..360),
    Data4=Slider(4.868, range=-360..360),
    Data5=Slider(-95.576, range=-360..360),
    Data6=Slider(-25.432, range=-360..360),
    Data7=Slider(-22.99, range=-360..360))
config = PythonScript(robot=attached_tool, val_track=number_slider_6, vals=merge)  # -> config, plane; inputs vals: list
# ---------- config: Python ----------
import math
from compas.robots import Configuration



config = Configuration.from_revolute_values([math.radians(a) for a in vals])
config.joint_values[0] = val_track/1000
print config

frame = robot.forward_kinematics(config,options=dict(solver="model"))
plane = [frame.point.x*1000,frame.point.y*1000,frame.point.z*1000]
# ---------- end config ----------

# ----
# Visualize Robot
toggle = BooleanToggle(True)
robot_visualize = RobotVisualize(robot=attached_tool, configuration=config.config, show_end_effector_frame=toggle)  # -> visual, collision, attached_meshes, frames, base_frame, ee_frame; inputs attached_collision_meshes: list, show_visual: Boolean, show_collision: Boolean, show_frames: Boolean, show_base_frame: Boolean, show_end_effector_frame: Boolean, show_acm: Boolean
#   port group: The planning group used for end-effector and base visualization.
#   port configuration: The robot's full configuration.
#   port attached_collision_meshes: A list of attached collision meshes.
#   port show_visual: Whether or not to show the robot's visual meshes.
#   port show_collision: Whether or not to show the robot's collision meshes.
#   port show_frames: Whether or not to show the robot's joint frames.
#   port show_base_frame: Whether or not to show the robot's base frame.
#   port show_end_effector_frame: Whether or not to show the robot's end-effector frame.
#   port show_acm: Whether or not to show the attached collision meshes (if any).
#   port visual: The robot's visual Rhino meshes (if any).
#   port collision: The robot's collision Rhino meshes (if any).
#   port attached_meshes: The attached collision Rhino meshes (if any).
#   port frames: The robot's joint frames as Rhino planes (if any).
#   port base_frame: The robot's base frame as a Rhino plane (if any).
#   port ee_frame: The robot's end-effector frame as a Rhino plane (if any).
# ---------- robot_visualize: Python ----------
"""
Visualizes the robot.

COMPAS FAB v0.24.0
"""
from compas.geometry import Frame
from compas.geometry import Transformation
from compas_ghpython.artists import FrameArtist
from compas_ghpython.artists import MeshArtist
from ghpythonlib.componentbase import executingcomponent as component


class RobotVisualize(component):
    def RunScript(self, robot, group, configuration, attached_collision_meshes, show_visual, show_collision,
                  show_frames, show_base_frame, show_end_effector_frame, show_acm):

        visual = None
        collision = None
        attached_meshes = None
        frames = None
        base_frame = None
        ee_frame = None

        if robot:
            show_visual = True if show_visual is None else show_visual
            configuration = configuration or robot.zero_configuration()

            robot.update(configuration, visual=show_visual, collision=show_collision)
            compas_frames = robot.transformed_frames(configuration, group)

            if show_visual:
                visual = robot.artist.draw_visual()

            if show_collision:
                collision = robot.artist.draw_collision()

            if show_base_frame:
                base_compas_frame = compas_frames[0]
                artist = FrameArtist(base_compas_frame)
                base_frame = artist.draw()

            if show_end_effector_frame:
                ee_compas_frame = robot.forward_kinematics(configuration, group, options=dict(solver='model'))
                artist = FrameArtist(ee_compas_frame)
                ee_frame = artist.draw()

            if show_frames:
                frames = []
                for compas_frame in compas_frames[1:]:
                    artist = FrameArtist(compas_frame)
                    frame = artist.draw()
                    frames.append(frame)

            if show_acm:
                attached_meshes = []
                for acm in attached_collision_meshes:
                    frame = robot.forward_kinematics(configuration, options=dict(solver='model', link_name=acm.link_name))
                    T = Transformation.from_frame_to_frame(Frame.worldXY(), frame)
                    mesh = acm.collision_mesh.mesh.transformed(T)
                    attached_meshes.append(MeshArtist(mesh).draw())

        return (visual, collision, attached_meshes, frames, base_frame, ee_frame)
# ---------- end robot_visualize ----------

merge_2 = Merge(Data1=move.Geometry, Data2=plane)

# ---- group: Linear
merge_3 = Merge(Data1=plane, Data2=move.Geometry)

# ---- group: Absoulute
merge_4 = Merge(Data1=move.Geometry, Data2=project.Geometry)

# ---- group: Linear
merge_5 = Merge(Data1=project.Geometry, Data2=target_plane)

merge_6 = Merge(Data1=target_plane, Data2=project.Geometry)

# ---- group: Absoulute
merge_7 = Merge(Data1=project.Geometry, Data2=move.Geometry)

# ----
# Linear Move
pln = Plane([Plane(origin=(5.05345365, 1.993188733, 1.5), x=(0, 1, 0), y=(1, 0, 0)), Plane(origin=(5.05345365, 1.993188733, 0), x=(0, 1, 0), y=(1, 0, 0))])
axis_values = Data(["335", "10", "2", "3", "4", "1", "1"])
dots = DotDisplay(Point=merge_2, Colour=RGB(0, 0, 0), Size=0.05)
python = GhPythonScript(robot=attached_tool, plane=pln, axis_values=axis_values)  # -> out, config; inputs plane: list of Plane, axis_values: list
# ---------- python: Python ----------
import math
import compas
from compas.robots import Configuration
from compas.geometry import Frame
from compas.geometry import Vector
from compas.geometry import add_vectors

####################################################################################
# create configuration from the axes values
####################################################################################
axis_values = _axis_values
axis_values[0] = axis_values[0]/100
for i in range(1, len(axis_values)):
    axis_values[i] = math.radians(axis_values[i])
start_config = Configuration.from_revolute_values(axis_values)


####################################################################################
# create inverse kinematics (without track) to a given plane, from the current configuration
####################################################################################


config = None
if _robot and _robot.client and _robot.client.is_connected and _plane:
    
    
    
    origin = [_plane[0].Origin.X,_plane[0].Origin.Y,_plane[0].Origin.Z]
    scale = -0.2
    translation_vector = [ _plane[0].ZAxis.X*scale,_plane[0].ZAxis.Y*scale,_plane[0].ZAxis.Z*scale]
    origin = add_vectors(origin, translation_vector)
    frame = Frame(
    [origin[0],origin[1],origin[2]], 
    [_plane[0].XAxis.X,_plane[0].XAxis.Y,_plane[0].XAxis.Z], 
    [_plane[0].YAxis.X,_plane[0].YAxis.Y,_plane[0].YAxis.Z])
    config = _robot.inverse_kinematics(frame, start_config, "manipulator")

####################################################################################
# add track to the configuration
####################################################################################
combo = []
combo.append(axis_values[0] )
combo.extend(config.joint_values)
_config = Configuration.from_revolute_values(combo)
# ---------- end python ----------

# ----
# Get Frame & Send Frame
button = Button()
ros_client = Data(ros_connect.ros_client)
python_2 = GhPythonScript(ros=ros_client, run=button, speed=Slider(100, range=0..300))
# ---------- python_2: Python ----------
import compas_rrc as rrc
from compas.geometry import Frame, Translation
abb = rrc.AbbClient(ros, '/rob1')
print('Connected.')

if run : 

    frame = abb.send_and_wait(rrc.GetFrame())
    T = Translation.from_vector([50,0,0])
    frame = frame.transformed(T)
    abb.send_and_wait(rrc.MoveToFrame(frame, speed, rrc.Zone.FINE, rrc.Motion.LINEAR), timeout = 10)
# ---------- end python_2 ----------

item_3 = ListItem(List=merge_3, Index=0, Wrap=True)

# ----
# Linear Move
axis_values_2 = Data(["335", "10", "2", "3", "4", "1", "1"])
python_3 = GhPythonScript(robot=attached_tool, plane=merge_3, axis_values=axis_values_2)  # -> out, config; inputs plane: list of Plane, axis_values: list
# ---------- python_3: Python ----------
import math
from compas.robots import Configuration
from compas.geometry import Frame

####################################################################################
# create configuration from the axes values
####################################################################################
axis_values = _axis_values
axis_values[0] = axis_values[0]/100
for i in range(1, len(axis_values)):
    axis_values[i] = math.radians(axis_values[i])
start_config = Configuration.from_revolute_values(axis_values)


####################################################################################
# create inverse kinematics (without track) to a given plane, from the current configuration
####################################################################################
config = None
if _robot and _robot.client and _robot.client.is_connected and _plane:
    print("Hi")
    pass
if _robot and _robot.client and _robot.client.is_connected and _plane:
    frame = Frame([_plane[0].Origin.X,_plane[0].Origin.Y,_plane[0].Origin.Z], [_plane[0].XAxis.X,_plane[0].XAxis.Y,_plane[0].XAxis.Z], [_plane[0].YAxis.X,_plane[0].YAxis.Y,_plane[0].YAxis.Z])
    config = _robot.inverse_kinematics(frame, start_config, "manipulator")

####################################################################################
# add track to the configuration
####################################################################################
combo = []
combo.append(axis_values[0] )
combo.extend(config.joint_values)
_config = Configuration.from_revolute_values(combo)
# ---------- end python_3 ----------
plan_cartesian_motion = PlanCartesianMotion(robot=attached_tool, planes=merge_3, start_configuration=python_3.config, max_step="0.1", compute="True")  # -> trajectory; inputs planes: list, attached_collision_meshes: list, path_constraints: list, compute: Boolean
#   port planes: The planes or frames through which the path is defined.
#   port start_configuration: The robot's full configuration, i.e. values for all configurable joints of the entire robot, at the starting position. Defaults to the all-zero configuration.
#   port group: The planning group used for calculation. Defaults to the robot's main planning group.
#   port attached_collision_meshes: A list of attached collision meshes to be included for planning.
#   port path_constraints: Optional constraints that can be imposed along the solution path. Note that path calculation won't work if the start_configuration violates these constraints. Defaults to None.
#   port max_step: The approximate distance between the calculated points. (Defined in the robot's units.) Defaults to 0.01.
#   port compute: If True, calculates a trajectory.
#   port trajectory: The calculated trajectory.
# ---------- plan_cartesian_motion: Python ----------
"""
Calculate a cartesian motion path (linear in tool space).

COMPAS FAB v0.27.0
"""
from compas_rhino.conversions import RhinoPlane
from ghpythonlib.componentbase import executingcomponent as component
from scriptcontext import sticky as st

from compas_fab.ghpython.components import create_id


class PlanCartesianMotion(component):
    def RunScript(self, robot, planes, start_configuration, group, attached_collision_meshes, path_constraints, max_step, compute):

        key = create_id(self, 'trajectory')

        max_step = float(max_step) if max_step else 0.01
        path_constraints = list(path_constraints) if path_constraints else None
        attached_collision_meshes = list(attached_collision_meshes) if attached_collision_meshes else None

        if robot and robot.client and robot.client.is_connected and start_configuration and planes and compute:
            frames = [RhinoPlane.from_geometry(plane).to_compas_frame() for plane in planes]
            st[key] = robot.plan_cartesian_motion(frames,
                                                  start_configuration=start_configuration,
                                                  group=group,
                                                  options=dict(
                                                      max_step=max_step,
                                                      path_constraints=path_constraints,
                                                      attached_collision_meshes=attached_collision_meshes
                                                  ))

        trajectory = st.get(key, None)
        return trajectory
# ---------- end plan_cartesian_motion ----------
trajectory_visualize = TrajectoryVisualize(robot=attached_tool, trajectory=plan_cartesian_motion)  # -> start_configuration, configurations, fraction, time, planes, P, V, A
#   port group: The planning group for which this trajectory was planned.
#   port trajectory: The calculated trajectory.
#   port start_configuration: The start configuration of the trajectory.
#   port configurations: The full configurations along the trajectory.
#   port fraction: Indicates the fraction of requested trajectory that was calculated, e.g. 1 means the full trajectory was found.
#   port time: The time which is needed to execute that trajectory at full speed.
#   port planes: The planes of the robot's end-effector.
#   port P: The positions along the trajectory
#   port V: The velocities along the trajectory
#   port A: The accelerations along the trajectory
# ---------- trajectory_visualize: Python ----------
"""
Visualizes a trajectory.

COMPAS FAB v0.27.0
"""
from compas_ghpython import draw_frame
from compas_ghpython import list_to_ghtree
from ghpythonlib.componentbase import executingcomponent as component


class TrajectoryVisualize(component):
    def RunScript(self, robot, group, trajectory):
        start_configuration = None
        configurations = []
        fraction = 0.
        time = 0.

        planes = []
        positions = []
        velocities = []
        accelerations = []

        if robot and trajectory:
            group = group or robot.main_group_name

            for c in trajectory.points:
                configurations.append(robot.merge_group_with_full_configuration(c, trajectory.start_configuration, group))
                frame = robot.forward_kinematics(c, group, options=dict(solver='model'))
                planes.append(draw_frame(frame))
                positions.append(c.positions)
                velocities.append(c.velocities)
                accelerations.append(c.accelerations)

            start_configuration = trajectory.start_configuration
            fraction = trajectory.fraction
            time = trajectory.time_from_start

        P = list_to_ghtree(list(zip(*positions)))
        V = list_to_ghtree(list(zip(*velocities)))
        A = list_to_ghtree(list(zip(*accelerations)))

        # return outputs if you have them; here I try it for you:
        return (start_configuration, configurations, fraction, time, planes, P, V, A)
# ---------- end trajectory_visualize ----------

# ----
# Joint Move
axis_values_3 = Data(["335", "10", "2", "3", "4", "1", "1"])
python_4 = GhPythonScript(robot=attached_tool, plane=merge_4, axis_values=axis_values_3)  # -> out, config0, config1; inputs plane: list of Plane, axis_values: list
# ---------- python_4: Python ----------
import math
from compas.robots import Configuration
from compas.geometry import Frame

def get_config(__plane_id , __robot, __planes, __axis_values):
    
    ####################################################################################
    # create configuration from the axes values
    ####################################################################################
    axis_values = []
    for i in range(len(__axis_values)):
        axis_values.append(__axis_values[i])
    axis_values[0] = axis_values[0]/100
    for i in range(1, len(axis_values)):
        axis_values[i] = math.radians(axis_values[i])
    start_config = Configuration.from_revolute_values(axis_values)
    
    
    
    ####################################################################################
    # create inverse kinematics (without track) to a given plane, from the current configuration
    ####################################################################################
    config = None
    if __robot and __robot.client and __robot.client.is_connected and __planes:
        frame = Frame(
        [__planes[__plane_id].Origin.X,__planes[__plane_id].Origin.Y,__planes[__plane_id].Origin.Z], 
        [__planes[__plane_id].XAxis.X,__planes[__plane_id].XAxis.Y,__planes[__plane_id].XAxis.Z], 
        [__planes[__plane_id].YAxis.X,__planes[__plane_id].YAxis.Y,__planes[__plane_id].YAxis.Z])
        config = _robot.inverse_kinematics(frame, start_config, "manipulator")
    
    ####################################################################################
    # add track to the configuration
    ####################################################################################
    combo = []
    combo.append(axis_values[0] )
    combo.extend(config.joint_values)
    config = Configuration.from_revolute_values(combo)
    return config


_config0 = get_config(0,_robot,_plane,_axis_values)
_config1 = get_config(1,_robot,_plane,_axis_values)


#_config_1 = get_config(1)
"""
_config_1 = get_config(1)
print(_config_0)
#print(_config_1)
"""
# ---------- end python_4 ----------
constraints_from_target_configuration = ConstraintsFromTargetConfiguration(robot=attached_tool, target_configuration=python_4.config1)  # -> constraints
#   port target_configuration: The target configuration.
#   port tolerance_above: The tolerances above the targeted joint value of each configurable joint, defining the upper bound in radians/meters to be achieved.
#   port tolerance_below: The tolerances below the targeted joint value of each configurable joint, defining the lower bound in radians/meters to be achieved.
#   port group: The planning group for which we specify the constraint. Defaults to the robot's main planning group.
#   port constraints: A list joint constraints in radians/meters.
# ---------- constraints_from_target_configuration: Python ----------
"""
Create joint constraints for each of the robot's configurable joints based on a given target configuration.

COMPAS FAB v0.27.0
"""
import math

from ghpythonlib.componentbase import executingcomponent as component


class ConstraintsFromTargetConfiguration(component):

    DEFAULT_TOLERANCE_METERS = .001
    DEFAULT_TOLERANCE_RADIANS = math.radians(1)

    def RunScript(self, robot, target_configuration, tolerance_above, tolerance_below, group):
        if robot and target_configuration:
            tolerance_above = tolerance_above or self._generate_default_tolerances(robot.get_configurable_joints(group))
            tolerance_below = tolerance_below or self._generate_default_tolerances(robot.get_configurable_joints(group))

            constraints = robot.constraints_from_configuration(
                configuration=target_configuration,
                tolerances_above=tolerance_above,
                tolerances_below=tolerance_below,
                group=group
            )

            return constraints

    def _generate_default_tolerances(self, joints):
        return [
            self.DEFAULT_TOLERANCE_METERS if j.is_scalable()
            else self.DEFAULT_TOLERANCE_RADIANS
            for j in joints
        ]
# ---------- end constraints_from_target_configuration ----------
plan_motion = PlanMotion(
    robot=attached_tool,
    goal_constraints=constraints_from_target_configuration,
    start_configuration=python_4.config0,
    compute="True")  # -> trajectory; inputs goal_constraints: list, attached_collision_meshes: list, path_constraints: list, compute: Boolean
#   port goal_constraints: The goal to be achieved, defined in a set of constraints. Constraints can be very specific, for example defining value domains for each joint, such that the goal configuration is included, or defining a volume in space, to which a specific robot link (e.g. the end-effector) is required to move to.
#   port start_configuration: The robot's full configuration, i.e. values for all configurable joints of the entire robot, at the starting position. Defaults to the all-zero configuration.
#   port group: The planning group used for calculation. Defaults to the robot's main planning group.
#   port attached_collision_meshes: A list of attached collision meshes to be included for planning.
#   port path_constraints: Optional constraints that can be imposed along the solution path. Note that path calculation won't work if the start_configuration violates these constraints. Defaults to None.
#   port planner_id: The name of the algorithm used for path planning. Defaults to 'RRTConnect'
#   port compute: If True, calculates a trajectory.
#   port trajectory: The calculated trajectory.
# ---------- plan_motion: Python ----------
"""
Calculate a motion path.

COMPAS FAB v0.27.0
"""
from ghpythonlib.componentbase import executingcomponent as component
from scriptcontext import sticky as st

from compas_fab.ghpython.components import create_id


class PlanMotion(component):
    def RunScript(self, robot, goal_constraints, start_configuration, group, attached_collision_meshes, path_constraints, planner_id, compute):

        key = create_id(self, 'trajectory')

        path_constraints = list(path_constraints) if path_constraints else None
        attached_collision_meshes = list(attached_collision_meshes) if attached_collision_meshes else None
        planner_id = str(planner_id) if planner_id else 'RRTConnect'

        if robot and robot.client and robot.client.is_connected and start_configuration and goal_constraints and compute:
            st[key] = robot.plan_motion(goal_constraints,
                                        start_configuration=start_configuration,
                                        group=group,
                                        options=dict(
                                            attached_collision_meshes=attached_collision_meshes,
                                            path_constraints=path_constraints,
                                            planner_id=planner_id,
                                        ))

        trajectory = st.get(key, None)
        return trajectory
# ---------- end plan_motion ----------
trajectory_visualize_2 = TrajectoryVisualize(robot=attached_tool, trajectory=plan_motion)  # -> start_configuration, configurations, fraction, time, planes, P, V, A; same code as trajectory_visualize

# ----
# Linear Move
axis_values_4 = Data(["335", "10", "2", "3", "4", "1", "1"])
python_5 = GhPythonScript(robot=attached_tool, plane=merge_5, axis_values=axis_values_4)  # -> out, config; inputs plane: list of Plane, axis_values: list
# ---------- python_5: Python ----------
import math
from compas.robots import Configuration
from compas.geometry import Frame

####################################################################################
# create configuration from the axes values
####################################################################################
axis_values = _axis_values
axis_values[0] = axis_values[0]/100
for i in range(1, len(axis_values)):
    axis_values[i] = math.radians(axis_values[i])
start_config = Configuration.from_revolute_values(axis_values)


####################################################################################
# create inverse kinematics (without track) to a given plane, from the current configuration
####################################################################################
config = None
if _robot and _robot.client and _robot.client.is_connected and _plane:
    frame = Frame([_plane[0].Origin.X,_plane[0].Origin.Y,_plane[0].Origin.Z], [_plane[0].XAxis.X,_plane[0].XAxis.Y,_plane[0].XAxis.Z], [_plane[0].YAxis.X,_plane[0].YAxis.Y,_plane[0].YAxis.Z])
    config = _robot.inverse_kinematics(frame, start_config, "manipulator")

####################################################################################
# add track to the configuration
####################################################################################
combo = []
combo.append(axis_values[0] )
combo.extend(config.joint_values)
_config = Configuration.from_revolute_values(combo)
# ---------- end python_5 ----------
plan_cartesian_motion_2 = PlanCartesianMotion(robot=attached_tool, planes=merge_5, start_configuration=python_5.config, max_step="0.1", compute="True")  # -> trajectory; inputs planes: list, attached_collision_meshes: list, path_constraints: list, compute: Boolean; same code as plan_cartesian_motion
trajectory_visualize_3 = TrajectoryVisualize(robot=attached_tool, trajectory=plan_cartesian_motion_2)  # -> start_configuration, configurations, fraction, time, planes, P, V, A; same code as trajectory_visualize

# ----
# Linear Move
axis_values_5 = Data(["335", "10", "2", "3", "4", "1", "1"])
python_6 = GhPythonScript(robot=attached_tool, plane=merge_6, axis_values=axis_values_5)  # -> out, config; inputs plane: list of Plane, axis_values: list; same code as python_5
plan_cartesian_motion_3 = PlanCartesianMotion(robot=attached_tool, planes=merge_6, start_configuration=python_6.config, max_step="0.1", compute="True")  # -> trajectory; inputs planes: list, attached_collision_meshes: list, path_constraints: list, compute: Boolean; same code as plan_cartesian_motion
trajectory_visualize_4 = TrajectoryVisualize(robot=attached_tool, trajectory=plan_cartesian_motion_3)  # -> start_configuration, configurations, fraction, time, planes, P, V, A; same code as trajectory_visualize

# ----
# Joint Move
axis_values_6 = Data(["335", "10", "2", "3", "4", "1", "1"])
python_7 = GhPythonScript(robot=attached_tool, plane=merge_7, axis_values=axis_values_6)  # -> out, config0, config1; inputs plane: list of Plane, axis_values: list; same code as python_4
constraints_from_target_configuration_2 = ConstraintsFromTargetConfiguration(robot=attached_tool, target_configuration=python_7.config1)  # -> constraints; same code as constraints_from_target_configuration
plan_motion_2 = PlanMotion(
    robot=attached_tool,
    goal_constraints=constraints_from_target_configuration_2,
    start_configuration=python_7.config0,
    compute="True")  # -> trajectory; inputs goal_constraints: list, attached_collision_meshes: list, path_constraints: list, compute: Boolean; same code as plan_motion
trajectory_visualize_5 = TrajectoryVisualize(robot=attached_tool, trajectory=plan_motion_2)  # -> start_configuration, configurations, fraction, time, planes, P, V, A; same code as trajectory_visualize

# ----
# Linear Move
axis_values_7 = Data(["335", "10", "2", "3", "4", "1", "1"])
python_8 = GhPythonScript(robot=attached_tool, plane=merge_2, axis_values=axis_values_7)  # -> out, config; inputs plane: list of Plane, axis_values: list; same code as python
plan_cartesian_motion_4 = PlanCartesianMotion(robot=attached_tool, planes=merge_2, start_configuration=python_8.config, max_step="0.1", compute="True")  # -> trajectory; inputs planes: list, attached_collision_meshes: list, path_constraints: list, compute: Boolean; same code as plan_cartesian_motion
trajectory_visualize_6 = TrajectoryVisualize(robot=attached_tool, trajectory=plan_cartesian_motion_4)  # -> start_configuration, configurations, fraction, time, planes, P, V, A; same code as trajectory_visualize

item_4 = ListItem(List=merge_2, Index=0, Wrap=True)
item_5 = ListItem(List=merge_2, Index=0, Wrap=True)
plan_cartesian_motion_5 = PlanCartesianMotion(robot=attached_tool, planes=pln, start_configuration=python.config, max_step="0.1", compute="True")  # -> trajectory; inputs planes: list, attached_collision_meshes: list, path_constraints: list, compute: Boolean; same code as plan_cartesian_motion

# ----
# Get Joint & Send Joint
number_slider_7 = Slider(100, range=0..300)
ros_client_2 = Data(ros_connect.ros_client)
python_9 = GhPythonScript(ros=ros_client_2, run=Button(), speed=number_slider_7)
# ---------- python_9: Python ----------
import compas_rrc as rrc
from compas.geometry import Frame, Translation
abb = rrc.AbbClient(ros, '/rob1')
print('Connected.')

if run : 

    # Get joints
    robot_joints, external_axes = abb.send_and_wait(rrc.GetJoints())
    
    # Print received values
    print(robot_joints, external_axes)
    
    # Change value and move to new position
    robot_joints.rax_1 += 15
    speed = 100 # Unit [mm/s]
    done = abb.send_and_wait(rrc.MoveToJoints(robot_joints, external_axes, speed, rrc.Zone.FINE))
# ---------- end python_9 ----------

ik = InverseKinematics(robot=attached_tool, plane=item_5)  # -> configuration
#   port plane: The plane or frame to calculate the inverse kinematic for.
#   port start_configuration: If passed, calculates the inverse such that the joint positions differ the least from the start_configuration. Defaults to the zero configuration.
#   port group: The planning group used for calculation. Defaults to the robot's main planning group.
#   port configuration: The planning group's configuration.
# ---------- ik: Python ----------
"""
Calculate the robot's inverse kinematic for a given plane.

COMPAS FAB v0.27.0
"""
from compas_rhino.conversions import RhinoPlane
from ghpythonlib.componentbase import executingcomponent as component


class InverseKinematics(component):
    def RunScript(self, robot, plane, start_configuration, group):
        configuration = None
        if robot and robot.client and robot.client.is_connected and plane:
            frame = RhinoPlane.from_geometry(plane).to_compas_frame()
            configuration = robot.inverse_kinematics(frame, start_configuration, group)
        return configuration
# ---------- end ik ----------
panel = Panel(ik)
trajectory_visualize_7 = TrajectoryVisualize(robot=attached_tool, trajectory=plan_cartesian_motion_5)  # -> start_configuration, configurations, fraction, time, planes, P, V, A; same code as trajectory_visualize

# ----
# Get Robtarget & Send Robtarget
number_slider_8 = Slider(100, range=0..300)
ros_client_3 = Data(ros_connect.ros_client)
python_10 = GhPythonScript(ros=ros_client_3, run=Button(), speed=number_slider_8)
# ---------- python_10: Python ----------
import compas_rrc as rrc
from compas.geometry import Frame, Translation
abb = rrc.AbbClient(ros, '/rob1')
print('Connected.')

if run : 

    # Get frame and external axes
    frame, external_axes = abb.send_and_wait(rrc.GetRobtarget())
    
    # Print received values
    print(frame, external_axes)
    
    # Change any value and move to new position
    frame.point[0] += 50
    done = abb.send_and_wait(rrc.MoveToRobtarget(frame, external_axes, speed, rrc.Zone.FINE))
# ---------- end python_10 ----------

item_6 = ListItem(List=trajectory_visualize_6.planes, Index=0, Wrap=True)
points = PointList(Points=trajectory_visualize_6.planes, Size=0.05)
entwine = Entwine(
    Branch00=trajectory_visualize_6.configurations,
    Branch01=trajectory_visualize.configurations,
    Branch02=trajectory_visualize_2.configurations,
    Branch03=trajectory_visualize_3.configurations,
    Branch04=trajectory_visualize_4.configurations,
    Branch05=trajectory_visualize_5.configurations,
    FlattenInputs=True)
entwine_2 = Entwine(
    Branch00=trajectory_visualize_6.planes,
    Branch01=trajectory_visualize.planes,
    Branch02=trajectory_visualize_2.planes,
    Branch03=trajectory_visualize_3.planes,
    Branch04=trajectory_visualize_4.planes,
    Branch05=trajectory_visualize_5.planes,
    FlattenInputs=True)

# ----
# Visualize Robot
number_slider_9 = Slider(0, range=0..25)
item_7 = ListItem(List=flatten(trajectory_visualize_6.configurations), Index=number_slider_9, Wrap=True)
robot_visualize_2 = RobotVisualize(robot=attached_tool, configuration=item_7, show_end_effector_frame=Toggle(True))  # -> visual, collision, attached_meshes, frames, base_frame, ee_frame; inputs attached_collision_meshes: list, show_visual: Boolean, show_collision: Boolean, show_frames: Boolean, show_base_frame: Boolean, show_end_effector_frame: Boolean, show_acm: Boolean; same code as robot_visualize

# ----
# Send to Robot
number_slider_10 = Slider(100, range=0..1000)
ros_client_4 = Data(ros_connect.ros_client)
python_11 = GhPythonScript(configs=entwine, ros=ros_client_4, planes=entwine_2, run=Toggle(False), speed=number_slider_10)  # -> out, a; inputs configs: tree, planes: tree of Plane
# ---------- python_11: Python ----------
import compas_rrc as rrc
import compas
import math
from compas.geometry import Frame, Translation
abb = rrc.AbbClient(ros, '/rob1')
print('Connected.')



if run : 
    for count in range (configs.BranchCount):
        
        # open the gripper
        
        if(count == 0 or count == 4):
            print('light_in')
            abb.send_and_wait(rrc.SetDigital('Local_IO_0_DO1', 0), timeout=5) #open
            abb.send_and_wait(rrc.WaitTime(1))
            print('light')
        
        if(count == 1):
            print('light_in')
            abb.send_and_wait(rrc.SetDigital('Local_IO_0_DO1', 1), timeout=5) #open
            abb.send_and_wait(rrc.WaitTime(1))
            print('light')
        
        config_0 = configs.Branch(count)
        
        
        # move robot configuration by configuration using joint values
        for i in range(0, len(config_0)):
            # Change value and move to new position
            
            robot_joints_updated = [
                math.degrees(config_0[i].joint_values[1]),
                math.degrees(config_0[i].joint_values[2]),
                math.degrees(config_0[i].joint_values[3]),
                math.degrees(config_0[i].joint_values[4]),
                math.degrees(config_0[i].joint_values[5]),
                math.degrees(config_0[i].joint_values[6])
            ]
            external_axes_updated = [
                config_0[i].joint_values[0]*1000
            ]
            
            
            done = abb.send(rrc.MoveToJoints(robot_joints_updated, external_axes_updated, speed, rrc.Zone.FINE))
            
        # move to frame to be more precise
        if(i == 0 or i == 3):
            frame = Frame([planes[-1].OriginX, planes[-1].OriginY, planes[-1].OriginZ], [planes[-1].XAxis.X, planes[-1].XAxis.Y, planes[-1].XAxis.Z], [planes[-1].YAxis.X, planes[-1].YAxis.Y, planes[-1].YAxis.Z])
            abb.send_and_wait(rrc.MoveToFrame(frame, speed, rrc.Zone.FINE, rrc.Motion.LINEAR), timeout = 10)
# ---------- end python_11 ----------
