# Grasshopper definition abb_irbt_6700_dual_robot_planning.gh (Grasshopper 1.0.7)

info = Info()  # -> info
#   port info: Environment info.
# ---------- info: Python ----------
"""
Displays information about the active COMPAS environment.
"""
import compas_bootstrapper
from ghpythonlib.componentbase import executingcomponent as component

import compas
import compas_fab


class CompasInfo(component):
    def RunScript(self):
        self.Message = 'COMPAS v{}'.format(compas.__version__)
        info = 'COMPAS Version: {}\nEnvironment: {}\nCOMPAS FAB Version:{}'
        return (info.format(compas.__version__, compas_bootstrapper.ENVIRONMENT_NAME,compas_fab.__version__))
# ---------- end info ----------
# Inverse Kinematics
point = Point(Point(1.76250996, 1.443780562, 0.2717226561))
point_2 = Point(Point(4.001525247, 1.443780562, 0.2717226561))
# Plan Motion
point_3 = Point(Point(2.190237987, 1.443780562, 0.547365822))
# Plan Cartesian Motion for one robot
point_4 = Point(Point(2.190237987, 1.443780562, 0.547365822))
# Dual ABB IRB6700 Playground - 05232024
# Author: Jingwen Wang
# Email: jingwen.wang@epfl.ch
your_version = Panel(info)
flip_plane = FlipPlane(Plane=point, ReverseX=False, ReverseY=False, SwapAxes=True)
flip_plane_2 = FlipPlane(Plane=point_2, ReverseX=False, ReverseY=False, SwapAxes=True)
flip_plane_3 = FlipPlane(Plane=point_3, ReverseX=False, ReverseY=False, SwapAxes=True)
flip_plane_4 = FlipPlane(Plane=point_4, ReverseX=False, ReverseY=False, SwapAxes=True)
# Package Version: COMPAS Version: 1.17.5
# 
# 
# COMPAS FAB Version:0.28.0
ros_connect = ROSConnect(connect=Toggle(True))  # -> ros_client, is_connected; inputs port: Int32, connect: Boolean
#   port ip: The ip address ROS. Defaults to 127.0.0.1.
#   port port: The port of ROS. Defaults to 9090.
#   port connect: If True, connects to ROS. If False, disconnects from ROS. Defaults to False.
#   port ros_client: The ROS client.
#   port is_connected: True if connection established.
# ---------- ros_connect: Python ----------
"""
Connect or disconnect to ROS.

COMPAS FAB v0.28.0
"""
from ghpythonlib.componentbase import executingcomponent as component
from scriptcontext import sticky as st

from compas_fab.backends import RosClient
from compas_fab.ghpython.components import create_id


class ROSConnect(component):
    def RunScript(self, ip, port, connect):
        ros_client = None

        ip = ip or "127.0.0.1"
        port = port or 9090

        key = create_id(self, "ros_client")
        ros_client = st.get(key, None)

        if ros_client:
            st[key].close()
        if connect:
            st[key] = RosClient(ip, port)
            st[key].run(5)

        ros_client = st.get(key, None)
        is_connected = ros_client.is_connected if ros_client else False
        return (ros_client, is_connected)
# ---------- end ros_connect ----------
deconstruct_plane = DeconstructPlane(Plane=flip_plane_3)  # -> Origin, XAxis, YAxis, ZAxis
deconstruct_plane_2 = DeconstructPlane(Plane=flip_plane_4)  # -> Origin, XAxis, YAxis, ZAxis
amplitude = Amplitude(Vector=deconstruct_plane_2.ZAxis, Amplitude=Slider(-0.2, range=-0.2..0))
amplitude_2 = Amplitude(Vector=deconstruct_plane.ZAxis, Amplitude=Slider(-0.16, range=-0.2..0))
move = Move(Geometry=flip_plane_4, Motion=amplitude)  # -> Geometry, Transform
move_2 = Move(Geometry=flip_plane_3, Motion=amplitude_2)  # -> Geometry, Transform
rotate = Rotate(Geometry=move_2.Geometry, Angle=1.570796327, Plane=move_2.Geometry)  # -> Geometry, Transform
ros_robot = ROSRobot(ros_client=ros_connect.ros_client, load=Toggle(True))  # -> robot; inputs load: Boolean
#   port ros_client: The ROS client.
#   port load: If True, loads the robot from ROS. Defaults to False.
# ---------- ros_robot: Python ----------
"""
Load robot directly from ROS.

COMPAS FAB v0.28.0
"""
from compas_ghpython.artists import RobotModelArtist
from ghpythonlib.componentbase import executingcomponent as component
from scriptcontext import sticky as st

from compas_fab.ghpython.components import create_id


class ROSRobot(component):
    def RunScript(self, ros_client, load):
        key = create_id(self, "robot")

        if ros_client and ros_client.is_connected and load:
            # Load URDF from ROS
            st[key] = ros_client.load_robot(load_geometry=True, precision="12f")
            st[key].artist = RobotModelArtist(st[key].model)

        robot = st.get(key, None)
        if robot:  # client sometimes need to be restarted, without needing to reload geometry
            robot.client = ros_client
        return robot
# ---------- end ros_robot ----------
inverse_kinematics = InverseKinematics(robot=ros_robot, plane=flip_plane_2, group="rob2_track")  # -> configuration
#   port plane: The plane or frame to calculate the inverse kinematic for.
#   port start_configuration: If passed, calculates the inverse such that the joint positions differ the least from the start_configuration. Defaults to the zero configuration.
#   port group: The planning group used for calculation. Defaults to the robot's main planning group.
#   port configuration: The planning group's configuration.
# ---------- inverse_kinematics: Python ----------
"""
Calculate the robot's inverse kinematic for a given plane.

COMPAS FAB v0.28.0
"""
from compas_rhino.conversions import RhinoPlane
from ghpythonlib.componentbase import executingcomponent as component


class InverseKinematics(component):
    def RunScript(self, robot, plane, start_configuration, group):
        configuration = None
        if robot and robot.client and robot.client.is_connected and plane:
            frame = RhinoPlane.from_geometry(plane).to_compas_frame()
            configuration = robot.inverse_kinematics(frame, start_configuration, group)
        return configuration
# ---------- end inverse_kinematics ----------
inverse_kinematics_2 = InverseKinematics(robot=ros_robot, plane=flip_plane, group="rob1_track")  # -> configuration; same code as inverse_kinematics
ghpython_script = GhPythonScript(plane_0=flip_plane_4, plane_1=move.Geometry)  # -> out, frames
# ---------- ghpython_script: Python ----------
from compas.geometry import Frame
from compas_rhino.conversions import plane_to_compas_frame

frames = []
frames.append(plane_to_compas_frame(plane_0))
frames.append(plane_to_compas_frame(plane_1))
# ---------- end ghpython_script ----------
constraints_from_plane = ConstraintsFromPlane(robot=ros_robot, plane=rotate.Geometry, group="rob1_track")  # -> constraints
#   port plane: The plane or frame from which we create position and orientation constraints.
#   port group: The planning group for which we specify the constraint. Defaults to the robot's main planning group.
#   port tolerance_position: The allowed tolerance to the frame's position (defined in the robot's units). Defaults to 0.001
#   port tolerance_xaxis: The allowed tolerance of the frame's X-axis in degrees.
#   port tolerance_yaxis: The allowed tolerance of the frame's Y-axis in degrees.
#   port tolerance_zaxis: The allowed tolerance of the frame's Z-axis in degrees.
#   port constraints: A list containing a position and an orientation constraint.
# ---------- constraints_from_plane: Python ----------
"""
Create a position and an orientation constraint from a plane calculated for the group's end-effector link.

COMPAS FAB v0.27.0
"""
import math

from compas_rhino.conversions import RhinoPlane
from ghpythonlib.componentbase import executingcomponent as component


class ConstraintsFromPlane(component):
    def RunScript(self, robot, plane, group, tolerance_position, tolerance_xaxis, tolerance_yaxis, tolerance_zaxis):
        goal_constraints = None
        if robot and plane:
            tolerance_position = tolerance_position or 0.001
            tolerance_xaxis = tolerance_xaxis or 1.
            tolerance_yaxis = tolerance_yaxis or 1.
            tolerance_zaxis = tolerance_zaxis or 1.

            frame = RhinoPlane.from_geometry(plane).to_compas_frame()
            tolerances_axes = [math.radians(tolerance_xaxis), math.radians(tolerance_yaxis), math.radians(tolerance_zaxis)]
            goal_constraints = robot.constraints_from_frame(frame, tolerance_position, tolerances_axes, group)

        return goal_constraints
# ---------- end constraints_from_plane ----------
panel = Panel("rob1")
merge_config = MergeConfig(config_a=inverse_kinematics_2, config_b=inverse_kinematics)  # -> config
#   port config_a: The configuration to use as base for the merge.
#   port config_b: The configuration used to merge into the base one.
#   port config: The merged configuration.
# ---------- merge_config: Python ----------
"""
Merge two configurations.

COMPAS FAB v0.28.0
"""
from ghpythonlib.componentbase import executingcomponent as component


class ConfigMerge(component):
    def RunScript(self, config_a, config_b):
        if config_a and config_b:
            return config_a.merged(config_b)

        return None
# ---------- end merge_config ----------

refresh = Button()
planning_scene = GhPythonScript(robot=ros_robot, refresh=refresh)  # -> a
# ---------- planning_scene: Python ----------
from compas_fab.robots import PlanningScene

from compas.artists import Artist
from compas.geometry import Frame
from compas.geometry import Transformation


scene = PlanningScene(robot)

collision_meshes = []
attached_collision_meshes = []

configuration = robot.zero_configuration()
scene = robot.client.get_planning_scene()

for co in scene.world.collision_objects:
    header = co.header
    frame_id = header.frame_id
    cms = co.to_collision_meshes()

    for cm in cms:
        if cm.frame != Frame.worldXY():
            t = Transformation.from_frame(cm.frame)
            mesh = cm.mesh.transformed(t)
        else:
            mesh = cm.mesh

        collision_meshes.append(mesh)

    for aco in scene.robot_state.attached_collision_objects:
        for acm in aco.to_attached_collision_meshes():
            frame_id = aco.object["header"]["frame_id"]
            frame = robot.forward_kinematics(configuration, options=dict(link=frame_id))
            t = Transformation.from_frame(frame)

            # Local CM frame
            if (acm.collision_mesh.frame and acm.collision_mesh.frame != Frame.worldXY()):
                t = t * Transformation.from_frame(acm.collision_mesh.frame)

            mesh = acm.collision_mesh.mesh.transformed(t)

            attached_collision_meshes.append(mesh)

a = []
for cm in collision_meshes + attached_collision_meshes:
    a.append(Artist(cm).draw_mesh())
# ---------- end planning_scene ----------

plan_cartesian_motion = PlanCartesianMotion(robot=ros_robot, planes=ghpython_script.frames, start_configuration=merge_config, group="rob1_track", compute=Button())  # -> trajectory; inputs planes: list, attached_collision_meshes: list, path_constraints: list, compute: Boolean
#   port planes: The planes or frames through which the path is defined.
#   port start_configuration: The robot's full configuration, i.e. values for all configurable joints of the entire robot, at the starting position. Defaults to the all-zero configuration.
#   port group: The planning group used for calculation. Defaults to the robot's main planning group.
#   port attached_collision_meshes: A list of attached collision meshes to be included for planning.
#   port path_constraints: Optional constraints that can be imposed along the solution path. Note that path calculation won't work if the start_configuration violates these constraints. Defaults to None.
#   port max_step: The approximate distance between the calculated points. (Defined in the robot's units.) Defaults to 0.01.
#   port compute: If True, calculates a trajectory.
#   port trajectory: The calculated trajectory.
# ---------- plan_cartesian_motion: Python ----------
"""
Calculate a cartesian motion path (linear in tool space).

COMPAS FAB v0.27.0
"""
from compas_rhino.conversions import RhinoPlane
from ghpythonlib.componentbase import executingcomponent as component
from scriptcontext import sticky as st

from compas_fab.ghpython.components import create_id


class PlanCartesianMotion(component):
    def RunScript(self, robot, planes, start_configuration, group, attached_collision_meshes, path_constraints, max_step, compute):

        key = create_id(self, 'trajectory')

        max_step = float(max_step) if max_step else 0.01
        path_constraints = list(path_constraints) if path_constraints else None
        attached_collision_meshes = list(attached_collision_meshes) if attached_collision_meshes else None

        if robot and robot.client and robot.client.is_connected and start_configuration and planes and compute:
            print("compute")
            frames = [RhinoPlane.from_geometry(plane).to_compas_frame() for plane in planes]
            st[key] = robot.plan_cartesian_motion(frames,
                                                  start_configuration=start_configuration,
                                                  group=group,
                                                  options=dict(
                                                      max_step=max_step,
                                                      path_constraints=path_constraints,
                                                      attached_collision_meshes=attached_collision_meshes
                                                  ))

        trajectory = st.get(key, None)
        return trajectory
# ---------- end plan_cartesian_motion ----------
plan_motion = PlanMotion(
    robot=ros_robot,
    goal_constraints=constraints_from_plane,
    start_configuration=merge_config,
    group="rob1_track",
    compute=Button())  # -> trajectory; inputs goal_constraints: list, attached_collision_meshes: list, path_constraints: list, compute: Boolean
#   port goal_constraints: The goal to be achieved, defined in a set of constraints. Constraints can be very specific, for example defining value domains for each joint, such that the goal configuration is included, or defining a volume in space, to which a specific robot link (e.g. the end-effector) is required to move to.
#   port start_configuration: The robot's full configuration, i.e. values for all configurable joints of the entire robot, at the starting position. Defaults to the all-zero configuration.
#   port group: The planning group used for calculation. Defaults to the robot's main planning group.
#   port attached_collision_meshes: A list of attached collision meshes to be included for planning.
#   port path_constraints: Optional constraints that can be imposed along the solution path. Note that path calculation won't work if the start_configuration violates these constraints. Defaults to None.
#   port planner_id: The name of the algorithm used for path planning. Defaults to 'RRTConnect'
#   port compute: If True, calculates a trajectory.
#   port trajectory: The calculated trajectory.
# ---------- plan_motion: Python ----------
"""
Calculate a motion path.

COMPAS FAB v0.27.0
"""
from ghpythonlib.componentbase import executingcomponent as component
from scriptcontext import sticky as st

from compas_fab.ghpython.components import create_id


class PlanMotion(component):
    def RunScript(self, robot, goal_constraints, start_configuration, group, attached_collision_meshes, path_constraints, planner_id, compute):

        key = create_id(self, 'trajectory')

        path_constraints = list(path_constraints) if path_constraints else None
        attached_collision_meshes = list(attached_collision_meshes) if attached_collision_meshes else None
        planner_id = str(planner_id) if planner_id else 'RRTConnect'

        if robot and robot.client and robot.client.is_connected and start_configuration and goal_constraints and compute:
            st[key] = robot.plan_motion(goal_constraints,
                                        start_configuration=start_configuration,
                                        group=group,
                                        options=dict(
                                            attached_collision_meshes=attached_collision_meshes,
                                            path_constraints=path_constraints,
                                            planner_id=planner_id,
                                        ))

        trajectory = st.get(key, None)
        return trajectory
# ---------- end plan_motion ----------
robot_visualize = RobotVisualize(robot=ros_robot, configuration=merge_config)  # -> visual, collision, collision_meshes, attached_meshes, frames, base_frame, ee_frame; inputs show_visual: Boolean, show_collision: Boolean, show_frames: Boolean, show_base_frame: Boolean, show_end_effector_frame: Boolean, show_cm: Boolean, show_acm: Boolean; disabled
#   port group: The planning group used for end-effector and base visualization.
#   port configuration: The robot's full configuration.
#   port show_visual: Whether or not to show the robot's visual meshes.
#   port show_collision: Whether or not to show the robot's collision meshes.
#   port show_frames: Whether or not to show the robot's joint frames.
#   port show_base_frame: Whether or not to show the robot's base frame.
#   port show_end_effector_frame: Whether or not to show the robot's end-effector frame.
#   port show_cm: Whether or not to show the collision meshes (if any).
#   port show_acm: Whether or not to show the attached collision meshes (if any).
#   port visual: Rhino meshes of the robot's visual geometry (if any).
#   port collision: Rhino meshes of the robot's collision geometry (if any).
#   port collision_meshes: Rhino meshes of the scene's collision meshes (if any).
#   port attached_meshes: Rhino meshes of the scene's attached collision meshes (if any).
#   port frames: The robot's joint frames as Rhino planes (if any).
#   port base_frame: The robot's base frame as a Rhino plane (if any).
#   port ee_frame: The robot's end-effector frame as a Rhino plane (if any).
# ---------- robot_visualize: Python ----------
"""
Visualizes the robot.

COMPAS FAB v0.28.0
"""
import time

from compas.artists import Artist
from compas.geometry import Frame
from compas.geometry import Transformation
from ghpythonlib.componentbase import executingcomponent as component
from scriptcontext import sticky as st

from compas_fab.ghpython.components import create_id
from compas_fab.robots import PlanningScene


class RobotVisualize(component):
    def RunScript(
        self,
        robot,
        group,
        configuration,
        show_visual,
        show_collision,
        show_frames,
        show_base_frame,
        show_end_effector_frame,
        show_cm,
        show_acm,
    ):
        visual = None
        collision = None
        collision_meshes = None
        attached_meshes = None
        frames = None
        base_frame = None
        ee_frame = None

        if robot:
            show_visual = True if show_visual is None else show_visual
            show_cm = True if show_cm is None else show_cm
            show_acm = True if show_acm is None else show_acm
            configuration = configuration or robot.zero_configuration()

            robot.update(configuration, visual=show_visual, collision=show_collision)
            compas_frames = robot.transformed_frames(configuration, group)

            if show_visual:
                visual = robot.artist.draw_visual()

            if show_collision:
                collision = robot.artist.draw_collision()

            if show_base_frame:
                base_compas_frame = compas_frames[0]
                artist = Artist(base_compas_frame)
                base_frame = artist.draw()

            if show_end_effector_frame:
                ee_compas_frame = robot.forward_kinematics(configuration, group, options=dict(solver="model"))
                artist = Artist(ee_compas_frame)
                ee_frame = artist.draw()

            if show_frames:
                frames = []
                for compas_frame in compas_frames[1:]:
                    artist = Artist(compas_frame)
                    frame = artist.draw()
                    frames.append(frame)

            cached_scene_key = create_id(self, "cached_scene")

            if show_cm or show_acm:
                cached_scene = st.get(cached_scene_key)
                if not cached_scene:
                    cached_scene = {"time": 0}

                # expire cache if the component has not been executed in the last 2 seconds
                # this allows to slide through a list of configurations
                # without triggering refreshes of the scene in the middle of it
                if time.time() - cached_scene["time"] > 2:
                    update_scene = True
                else:
                    update_scene = False

                if update_scene:
                    scene = PlanningScene(robot)
                    scene = robot.client.get_planning_scene()

                if update_scene and show_cm:
                    collision_meshes = []

                    for co in scene.world.collision_objects:
                        header = co.header
                        frame_id = header.frame_id
                        cms = co.to_collision_meshes()

                        for cm in cms:
                            if cm.frame != Frame.worldXY():
                                t = Transformation.from_frame(cm.frame)
                                mesh = cm.mesh.transformed(t)
                            else:
                                mesh = cm.mesh

                            collision_meshes.append(Artist(mesh).draw())

                        cached_scene["cm"] = collision_meshes

                collision_meshes = cached_scene.get("cm", [])

                if update_scene and show_acm:
                    attached_meshes = []

                    for aco in scene.robot_state.attached_collision_objects:
                        for acm in aco.to_attached_collision_meshes():
                            frame_id = aco.object["header"]["frame_id"]
                            frame = robot.forward_kinematics(configuration, options=dict(link=frame_id))
                            t = Transformation.from_frame(frame)

                            # Local CM frame
                            if acm.collision_mesh.frame and acm.collision_mesh.frame != Frame.worldXY():
                                t = t * Transformation.from_frame(acm.collision_mesh.frame)

                            mesh = acm.collision_mesh.mesh.transformed(t)

                            attached_meshes.append(Artist(mesh).draw())

                    cached_scene["acm"] = attached_meshes

                attached_meshes = cached_scene.get("acm", [])

                cached_scene["time"] = time.time()
                st[cached_scene_key] = cached_scene

        return (
            visual,
            collision,
            collision_meshes,
            attached_meshes,
            frames,
            base_frame,
            ee_frame,
        )
# ---------- end robot_visualize ----------
trajectory_visualize = TrajectoryVisualize(robot=ros_robot, group="rob1_track", trajectory=plan_cartesian_motion)  # -> start_configuration, configurations, fraction, time, planes, P, V, A
#   port group: The planning group for which this trajectory was planned.
#   port trajectory: The calculated trajectory.
#   port start_configuration: The start configuration of the trajectory.
#   port configurations: The full configurations along the trajectory.
#   port fraction: Indicates the fraction of requested trajectory that was calculated, e.g. 1 means the full trajectory was found.
#   port time: The time which is needed to execute that trajectory at full speed.
#   port planes: The planes of the robot's end-effector.
#   port P: The positions along the trajectory
#   port V: The velocities along the trajectory
#   port A: The accelerations along the trajectory
# ---------- trajectory_visualize: Python ----------
"""
Visualizes a trajectory.

COMPAS FAB v0.27.0
"""
from compas_ghpython import draw_frame
from compas_ghpython import list_to_ghtree
from ghpythonlib.componentbase import executingcomponent as component


class TrajectoryVisualize(component):
    def RunScript(self, robot, group, trajectory):
        start_configuration = None
        configurations = []
        fraction = 0.
        time = 0.

        planes = []
        positions = []
        velocities = []
        accelerations = []

        if robot and trajectory:
            group = group or robot.main_group_name

            for c in trajectory.points:
                configurations.append(robot.merge_group_with_full_configuration(c, trajectory.start_configuration, group))
                frame = robot.forward_kinematics(c, group, options=dict(solver='model'))
                planes.append(draw_frame(frame))
                positions.append(c.positions)
                velocities.append(c.velocities)
                accelerations.append(c.accelerations)

            start_configuration = trajectory.start_configuration
            fraction = trajectory.fraction
            time = trajectory.time_from_start

        P = list_to_ghtree(list(zip(*positions)))
        V = list_to_ghtree(list(zip(*velocities)))
        A = list_to_ghtree(list(zip(*accelerations)))

        # return outputs if you have them; here I try it for you:
        return (start_configuration, configurations, fraction, time, planes, P, V, A)
# ---------- end trajectory_visualize ----------
trajectory_visualize_2 = TrajectoryVisualize(robot=ros_robot, group="rob1_track", trajectory=plan_motion)  # -> start_configuration, configurations, fraction, time, planes, P, V, A; same code as trajectory_visualize
merge_config_2 = MergeConfig(config_a=trajectory_visualize.configurations, config_b=graft(inverse_kinematics))  # -> config
#   port config_a: The configuration to use as base for the merge.
#   port config_b: The configuration used to merge into the base one.
#   port config: The merged configuration.
# ---------- merge_config_2: Python ----------
"""
Merge two configurations.

COMPAS FAB v0.27.0
"""
from ghpythonlib.componentbase import executingcomponent as component


class ConfigMerge(component):
    def RunScript(self, config_a, config_b):

        if config_a and config_b:
            return config_a.merged(config_b)

        return None
# ---------- end merge_config_2 ----------
list_item = ListItem(List=trajectory_visualize_2.configurations, Index=Slider(6, range=0..100), Wrap=True)
list_item_2 = ListItem(List=merge_config_2, Index=Slider(0, range=0..200), Wrap=True)
robot_visualize_2 = RobotVisualize(robot=ros_robot, configuration=list_item)  # -> visual, collision, collision_meshes, attached_meshes, frames, base_frame, ee_frame; inputs show_visual: Boolean, show_collision: Boolean, show_frames: Boolean, show_base_frame: Boolean, show_end_effector_frame: Boolean, show_cm: Boolean, show_acm: Boolean
#   port group: The planning group used for end-effector and base visualization.
#   port configuration: The robot's full configuration.
#   port show_visual: Whether or not to show the robot's visual meshes.
#   port show_collision: Whether or not to show the robot's collision meshes.
#   port show_frames: Whether or not to show the robot's joint frames.
#   port show_base_frame: Whether or not to show the robot's base frame.
#   port show_end_effector_frame: Whether or not to show the robot's end-effector frame.
#   port show_cm: Whether or not to show the collision meshes (if any).
#   port show_acm: Whether or not to show the attached collision meshes (if any).
#   port visual: Rhino meshes of the robot's visual geometry (if any).
#   port collision: Rhino meshes of the robot's collision geometry (if any).
#   port collision_meshes: Rhino meshes of the scene's collision meshes (if any).
#   port attached_meshes: Rhino meshes of the scene's attached collision meshes (if any).
#   port frames: The robot's joint frames as Rhino planes (if any).
#   port base_frame: The robot's base frame as a Rhino plane (if any).
#   port ee_frame: The robot's end-effector frame as a Rhino plane (if any).
# ---------- robot_visualize_2: Python ----------
"""
Visualizes the robot.

COMPAS FAB v0.27.0
"""
from compas.artists import Artist
from compas.geometry import Frame
from compas.geometry import Transformation
from compas_fab.robots import PlanningScene
from ghpythonlib.componentbase import executingcomponent as component


class RobotVisualize(component):
    def RunScript(
        self,
        robot,
        group,
        configuration,
        show_visual,
        show_collision,
        show_frames,
        show_base_frame,
        show_end_effector_frame,
        show_cm,
        show_acm,
    ):

        visual = None
        collision = None
        collision_meshes = None
        attached_meshes = None
        frames = None
        base_frame = None
        ee_frame = None

        if robot:
            show_visual = True if show_visual is None else show_visual
            show_cm = True if show_cm is None else show_cm
            show_acm = True if show_acm is None else show_acm
            configuration = configuration or robot.zero_configuration()

            robot.update(configuration, visual=show_visual, collision=show_collision)
            compas_frames = robot.transformed_frames(configuration, group)

            if show_visual:
                visual = robot.artist.draw_visual()

            if show_collision:
                collision = robot.artist.draw_collision()

            if show_base_frame:
                base_compas_frame = compas_frames[0]
                artist = Artist(base_compas_frame)
                base_frame = artist.draw()

            if show_end_effector_frame:
                ee_compas_frame = robot.forward_kinematics(
                    configuration, group, options=dict(solver="model")
                )
                artist = Artist(ee_compas_frame)
                ee_frame = artist.draw()

            if show_frames:
                frames = []
                for compas_frame in compas_frames[1:]:
                    artist = Artist(compas_frame)
                    frame = artist.draw()
                    frames.append(frame)

            if show_cm or show_acm:
                scene = PlanningScene(robot)
                scene = robot.client.get_planning_scene()

                collision_meshes = []
                attached_meshes = []

                if show_cm:
                    for co in scene.world.collision_objects:
                        header = co.header
                        frame_id = header.frame_id
                        cms = co.to_collision_meshes()

                        for cm in cms:
                            if cm.frame != Frame.worldXY():
                                t = Transformation.from_frame(cm.frame)
                                mesh = cm.mesh.transformed(t)
                            else:
                                mesh = cm.mesh

                            collision_meshes.append(Artist(mesh).draw())

                if show_acm:
                    for aco in scene.robot_state.attached_collision_objects:
                        for acm in aco.to_attached_collision_meshes():
                            frame_id = aco.object["header"]["frame_id"]
                            frame = robot.forward_kinematics(
                                configuration, options=dict(link=frame_id)
                            )
                            t = Transformation.from_frame(frame)

                            # Local CM frame
                            if (
                                acm.collision_mesh.frame
                                and acm.collision_mesh.frame != Frame.worldXY()
                            ):
                                t = t * Transformation.from_frame(
                                    acm.collision_mesh.frame
                                )

                            mesh = acm.collision_mesh.mesh.transformed(t)

                            attached_meshes.append(Artist(mesh).draw())

        return (
            visual,
            collision,
            collision_meshes,
            attached_meshes,
            frames,
            base_frame,
            ee_frame,
        )
# ---------- end robot_visualize_2 ----------
robot_visualize_3 = RobotVisualize(robot=ros_robot, configuration=list_item_2)  # -> visual, collision, collision_meshes, attached_meshes, frames, base_frame, ee_frame; inputs show_visual: Boolean, show_collision: Boolean, show_frames: Boolean, show_base_frame: Boolean, show_end_effector_frame: Boolean, show_cm: Boolean, show_acm: Boolean; disabled; same code as robot_visualize_2

# ---- group: set config
# Configuration A
# Robot Display
track = Slider(2.305, range=0..6.7)
# (No collision checking)
j1 = Slider(-92, range=-170..170)
j2 = Slider(1, range=-65..85)
j3 = Slider(5, range=-180..70)
j4 = Slider(88, range=-300..300)
j5 = Slider(8, range=-130..130)
j6 = Slider(5, range=-360..360)

# ----
merge = Merge(Data1=track, Data2=j1, Data3=j2, Data4=j3, Data5=j4, Data6=j5, Data7=j6)

# ---- group: set config (continued)
config = PythonScript(vals=merge)  # -> config; inputs vals: list
# ---------- config: Python ----------
import math
from compas.robots import Configuration

config = Configuration.from_prismatic_and_revolute_values([vals[0]],[math.radians(a) for a in vals[1:]])
print config.values
# ---------- end config ----------

# Configuration B
track_2 = Slider(0.611, range=0..6.7)
j1_2 = Slider(78, range=-170..170)
j2_2 = Slider(1, range=-65..85)
j3_2 = Slider(-71, range=-180..70)
j4_2 = Slider(-258, range=-300..300)
j5_2 = Slider(50, range=-130..130)
j6_2 = Slider(259, range=-360..360)

# ----
merge_2 = Merge(Data1=track_2, Data2=j1_2, Data3=j2_2, Data4=j3_2, Data5=j4_2, Data6=j5_2, Data7=j6_2)

# ---- group: set config (continued)
config_2 = PythonScript(vals=merge_2)  # -> config; inputs vals: list; same code as config

# ----
merge_config_3 = MergeConfig(robot=ros_robot, config_a=config, config_b=config_2, group_A="rob1_track", group_B="rob2_track")  # -> config
#   port config_a: The configuration to use as base for the merge.
#   port config_b: The configuration used to merge into the base one.
#   port config: The merged configuration.
# ---------- merge_config_3: Python ----------
"""
Merge two configurations.

COMPAS FAB v0.24.0
"""
from ghpythonlib.componentbase import executingcomponent as component


class ConfigMerge(component):
    def RunScript(self, robot, config_a, config_b, group_A, group_B):

        if config_a and config_b:
            config_A = robot.zero_configuration(group = group_A)
            config_A.joint_values = config_a.joint_values
            config_B = robot.zero_configuration(group = group_B)
            config_B.joint_values = config_b.joint_values
            return config_A.merged(config_B)

        return None
# ---------- end merge_config_3 ----------
robot_visualize_4 = RobotVisualize(robot=ros_robot, configuration=merge_config_3)  # -> visual, collision, collision_meshes, attached_meshes, frames, base_frame, ee_frame; inputs show_visual: Boolean, show_collision: Boolean, show_frames: Boolean, show_base_frame: Boolean, show_end_effector_frame: Boolean, show_cm: Boolean, show_acm: Boolean; disabled; same code as robot_visualize_2
