# Grasshopper definition 01_gofa_playground_pick_and_place.gh (Grasshopper 1.0.7)
# plug-ins: Bifocals

# ----
# Robot model
connect = BooleanToggle(True)
ros = ROSConnect(connect=connect)  # -> ros_client, is_connected; inputs port: Int32, connect: Boolean
#   port ip: The ip address ROS. Defaults to 127.0.0.1.
#   port port: The port of ROS. Defaults to 9090.
#   port connect: If True, connects to ROS. If False, disconnects from ROS. Defaults to False.
#   port ros_client: The ROS client.
#   port is_connected: True if connection established.
# ---------- ros: Python ----------
"""
Connect or disconnect to ROS.

COMPAS FAB v0.27.0
"""
from ghpythonlib.componentbase import executingcomponent as component
from scriptcontext import sticky as st

from compas_fab.backends import RosClient
from compas_fab.ghpython.components import create_id


class ROSConnect(component):
    def RunScript(self, ip, port, connect):
        ros_client = None

        ip = ip or '127.0.0.1'
        port = port or 9090

        key = create_id(self, 'ros_client')
        ros_client = st.get(key, None)

        if ros_client:
            st[key].close()
        if connect:
            st[key] = RosClient(ip, port)
            st[key].run(5)

        ros_client = st.get(key, None)
        is_connected = ros_client.is_connected if ros_client else False
        return (ros_client, is_connected)
# ---------- end ros ----------
load_robot = BooleanToggle(True)
robot = ROSRobot(ros_client=ros.ros_client, load=load_robot)  # -> robot; inputs load: Boolean
#   port ros_client: The ROS client.
#   port load: If True, loads the robot from ROS. Defaults to False.
# ---------- robot: Python ----------
"""
Load robot directly from ROS.

COMPAS FAB v0.27.0
"""
from compas_ghpython.artists import RobotModelArtist
from ghpythonlib.componentbase import executingcomponent as component
from scriptcontext import sticky as st

from compas_fab.ghpython.components import create_id


class ROSRobot(component):
    def RunScript(self, ros_client, load):
        key = create_id(self, 'robot')

        if ros_client and ros_client.is_connected and load:
            # Load URDF from ROS
            st[key] = ros_client.load_robot(load_geometry=True, precision='12f')
            st[key].artist = RobotModelArtist(st[key].model)

        robot = st.get(key, None)
        if robot:  # client sometimes need to be restarted, without needing to reload geometry
            robot.client = ros_client
        return robot
# ---------- end robot ----------

# ----
# Table
# Brick Design
swatch = ColourSwatch(SwatchColor=RGB(255, 254, 254))
brep = Brep(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)
material = CreateMaterial(Diffuse=swatch, Specular=RGB(255, 254, 254), Emission=RGB(0, 0, 0), Transparency=0, Shine=0)
preview = CustomPreview(Geometry=brep, Material=material)

info = Info()  # -> info
#   port info: Environment info.
# ---------- info: Python ----------
"""
Displays information about the active COMPAS environment.
"""
import compas_bootstrapper
from ghpythonlib.componentbase import executingcomponent as component

import compas_fab


class CompasInfo(component):
    def RunScript(self):
        self.Message = "COMPAS FAB v{}".format(compas_fab.__version__)
        info = "COMPAS FAB Version: {}\nEnvironment: {}"
        return info.format(compas_fab.__version__, compas_bootstrapper.ENVIRONMENT_NAME)
# ---------- end info ----------
info_2 = Info()  # -> info
#   port info: Environment info.
# ---------- info_2: Python ----------
"""
Displays information about the active COMPAS environment.
"""
import compas_bootstrapper
from ghpythonlib.componentbase import executingcomponent as component

import compas


class CompasInfo(component):
    def RunScript(self):
        self.Message = "COMPAS v{}".format(compas.__version__)
        info = "COMPAS Version: {}\nEnvironment: {}"
        return info.format(compas.__version__, compas_bootstrapper.ENVIRONMENT_NAME)
# ---------- end info_2 ----------

# ---- group: brick assembly design
brep_2 = Brep([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])

# ----
# Tool
gripper_meshes = Mesh([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])
gripper_bounding_box_mesh = Mesh(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)
gripper_tcf = Plane(Plane(origin=(0, 0, 0.1534), x=(-0.7071067812, 0.7071067812, 0), y=(-0.7071067812, -0.7071067812, 0)))
mjoin = MeshJoin(Meshes=gripper_meshes)
tool = AttachedTool(robot=robot, visual_mesh=mjoin, collision_mesh=gripper_bounding_box_mesh, tcf_plane=gripper_tcf)  # -> robot; inputs visual_mesh: Mesh, collision_mesh: Mesh
#   port visual_mesh: A visual mesh for the tool.
#   port collision_mesh: A collision mesh for the tool.
#   port tcf_plane: The frame of the tool in tool0 frame.
#   port group: The planning group to which the tool should be attached.
# ---------- tool: Python ----------
"""
Attach a tool to the robot.

COMPAS FAB v0.27.0
"""
from ghpythonlib.componentbase import executingcomponent as component
from compas_rhino.conversions import RhinoMesh
from compas_rhino.conversions import plane_to_compas_frame

from compas.geometry import Frame
from compas_fab.robots import Tool


class AttachToolComponent(component):
    def RunScript(self, robot, visual_mesh, collision_mesh, tcf_plane, group):
        if robot and robot.client and robot.client.is_connected and visual_mesh:
            if not collision_mesh:
                collision_mesh = visual_mesh

            c_visual_mesh = RhinoMesh.from_geometry(visual_mesh).to_compas()
            c_collision_mesh = RhinoMesh.from_geometry(collision_mesh).to_compas()

            if not tcf_plane:
                frame = Frame.worldXY()
            else:
                frame = plane_to_compas_frame(tcf_plane)
                print frame.quaternion
            tool = Tool(c_visual_mesh, frame, c_collision_mesh)

            robot.attach_tool(tool, group)

        return robot
# ---------- end tool ----------

safety_distance = Slider(0.05, range=0..0.1)
panel = Panel(info_2)
panel_2 = Panel(info)
# Pick n’ Place
reset = Button()
back = Button()
start = Button()
stop = Button()
step = Button()
full = Button()
home_vertical = Plane(Plane(origin=(0.5500001406, -4.288937592e-07, 0.5645949341), x=(-1, 3.94200436e-06, 3.857708226e-06), y=(3.942004287e-06, 1, -1.890032101e-08)))
place_planes = Plane([Plane(origin=(0.634122438, 0.2406475275, 0.0185), x=(0.9191723522, 0.3938555407, 0), y=(0.3938555407, -0.9191723522, 0)), Plane(origin=(0.6659832771, 0.1466559322, 0.0185), x=(0.2458730443, -0.9693020407, 0), y=(-0.9693020407, -0.2458730443, 0)), Plane(origin=(0.6830988961, 0.03495857814, 0.0185), x=(0.04903497868, -0.9987970619, 0), y=(-0.9987970619, -0.04903497868, 0)), Plane(origin=(0.6756570645, -0.07794872457, 0.0185), x=(-0.1753417489, -0.9845076288, 0), y=(-0.9845076288, 0.1753417489, 0)), Plane(origin=(0.6459377177, -0.1845546872, 0.0185), x=(-0.3557828931, -0.9345686347, 0), y=(-0.9345686347, 0.3557828931, 0)), Plane(origin=(0.6600988427, 0.1996052589, 0.0456999992), x=(0.3086913898, -0.95116225, 0), y=(-0.95116225, -0.3086913898, 0))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])
pick_plane = Plane(Plane(origin=(1.075157389e-05, 0.4789661213, 0.01515229383), x=(-0.9999999998, -1.356235076e-05, -1.363541853e-05), y=(-1.35601801e-05, 0.9999999872, -0.0001591803698)))
counter = CountThroughList(assembly=place_planes, start=start, stop=stop, step=step, step_back=back, reset=reset, full=full)  # -> item, counter; inputs assembly: list of Plane, start: Boolean, stop: Boolean, step_back: Boolean
# ---------- counter: Python ----------
from scriptcontext import sticky as st
from compas_ghpython import update_component


L = assembly
# store data in component
guid = str(ghenv.Component.InstanceGuid)
counter_key = "counter_" + guid
running_key = "running_" + guid

if counter_key not in st:
    st[counter_key] = 0

if running_key not in st:
    st[running_key] = False
    

if st[running_key]:
    if st[counter_key] < len(L) - 1:
        st[counter_key] += 1
        update_component(ghenv, interval)
    else:
        st[counter_key] = 0
        st[running_key] = False
    
    
if start:
    st[running_key] = True

if stop:
    st[running_key] = False

if step:
    if st[counter_key] < len(L) - 1:
        st[counter_key] += 1

if step_back:
    if st[counter_key] < len(L):
        st[counter_key] -= 1

if reset:
    st[counter_key] = 0

if full:
    st[counter_key] = len(L)-1

if len(L):
    item = L[st[counter_key]]



counter = st[counter_key]
# ---------- end counter ----------
panel_3 = Panel(ros.is_connected)
scene = PlanningScene(robot=tool)  # -> scene
#   port scene: A planning scene.
# ---------- scene: Python ----------
"""
Create a planning scene.

COMPAS FAB v0.27.0
"""
from ghpythonlib.componentbase import executingcomponent as component
from scriptcontext import sticky as st

from compas_fab.ghpython.components import create_id
from compas_fab.robots import PlanningScene


class PlanningSceneComponent(component):
    def RunScript(self, robot):
        key = create_id(self, 'planning_scene')
        if robot:
            st[key] = PlanningScene(robot)
        return st.get(key, None)
# ---------- end scene ----------
list = ValueList({"Send all elements": "all", "Send current element": "current"}, selected="Send current element")
cm = CollisionMesh(scene=scene, mesh=brep, identifier="table", add=Toggle(True), append=Toggle(False), remove=Toggle(False))  # -> ok; inputs mesh: Mesh, add: Boolean, append: Boolean, remove: Boolean
#   port scene: The planning scene.
#   port mesh: A collision mesh.
#   port identifier: The identifier of the collision mesh.
#   port add: If True, adds the collision mesh to the planning scene.
#   port append: If True, appends the collision mesh to the planning scene.
#   port remove: If True, removes the collision mesh from the planning scene.
#   port ok: True if the operation was successfully performed.
# ---------- cm: Python ----------
"""
Add or remove a collision mesh from the planning scene.

COMPAS FAB v0.27.0
"""
from compas_rhino.geometry import RhinoMesh
from ghpythonlib.componentbase import executingcomponent as component

from compas_fab.robots import CollisionMesh


class CollisionMeshComponent(component):
    def RunScript(self, scene, M, name, add, append, remove):
        ok = False
        self.Message = ""

        if (add and append) or (append and remove) or (add and remove):
            self.Message = "Use only one operation at a time\n(add, append or remove)"
            raise Exception(self.Message)

        if scene and M and name:
            mesh = RhinoMesh.from_geometry(M).to_compas()
            collision_mesh = CollisionMesh(mesh, name)
            if add:
                scene.add_collision_mesh(collision_mesh)
                self.Message = "Added"
                ok = True
            if append:
                scene.append_collision_mesh(collision_mesh)
                self.Message = "Appended"
                ok = True
            if remove:
                scene.remove_collision_mesh(name)
                self.Message = "Removed"
                ok = True
        return ok
# ---------- end cm ----------
sequence = GhPythonScript(pick_plane=pick_plane, place_planes=place_planes, home_vertical_plane=home_vertical, safety_distance=safety_distance)  # -> all_pick_sequence, all_place_sequence; inputs place_planes: list
# ---------- sequence: Python ----------
from compas_rhino.conversions import RhinoPlane
from compas.geometry import Translation, Vector
from compas_ghpython.artists import FrameArtist
from compas_ghpython.utilities import list_to_ghtree

T = Translation.from_vector(Vector.Zaxis()*safety_distance)

pick_safety_frame = RhinoPlane.from_geometry(pick_plane).to_compas_frame().transformed(T) 
pick_safety_plane = FrameArtist(pick_safety_frame).draw()

all_pick_sequence = []
all_place_sequence = []

for place_plane in place_planes:
    place_safety_frame = RhinoPlane.from_geometry(place_plane).to_compas_frame().transformed(T) 
    place_safety_plane = FrameArtist(place_safety_frame).draw()
    
    pick_sequence = list([place_safety_plane, home_vertical_plane, pick_safety_plane, pick_plane])
    place_sequence = list([pick_safety_plane, home_vertical_plane, place_safety_plane, place_plane])
    
    all_pick_sequence.append(pick_sequence)
    all_place_sequence.append(place_sequence)

all_pick_sequence = list_to_ghtree(all_pick_sequence)
all_place_sequence = list_to_ghtree(all_place_sequence)
# ---------- end sequence ----------
idx = Panel(counter.counter)
number_slider = Slider(1, range=0..10)
run = Button()

# ----
# Export to Json
list_2 = ValueList({"Export all elements": "all", "Export current element": "current"}, selected="Export current element")
export = Button()
send = GhPythonScript(
    export=export,
    export_elements=list_2,
    current_key=idx,
    all_pick_sequence=sequence.all_pick_sequence,
    all_place_sequence=sequence.all_place_sequence,
    speed=Slider(200, range=0..1000),
    file_name="pick_and_place")  # inputs current_key: Int32, all_pick_sequence: tree of Plane, all_place_sequence: tree of Plane
# ---------- send: Python ----------
from datetime import datetime as dt
from compas.geometry import Scale
import os
import compas
import sys
from compas_rhino import unload_modules
from compas_rhino.conversions import RhinoPlane, RhinoMesh
from compas.geometry import Scale, Frame
from compas_fab.robots import Robot
from compas_ghpython.utilities import ghtree_to_list
import compas_rrc as rrc
import time

HERE = ghenv.LocalScope.ghdoc.Path
DATA = os.path.abspath(os.path.join(HERE, '..', '..', 'data'))
now = dt.now().strftime("%Y%m%d_")
file_path = DATA + "/" + now + file_name + ".json"

path = DATA = os.path.abspath(os.path.join(HERE, '..', '..', 'python'))
if path not in sys.path:
    sys.path.append(path)

unload_modules('helper')
from helper import Action, ProductionData


all_pick_sequence = ghtree_to_list(all_pick_sequence)[0]
all_place_sequence = ghtree_to_list(all_place_sequence)[0]

if export_elements == "current":
    all_pick_sequence = list([all_pick_sequence[current_key]])
    all_place_sequence = list([all_place_sequence[current_key]])

actions = []

scalefactor = 1000
S = Scale.from_factors([scalefactor] * 3)

# Set tool
actions.append(Action('SetTool', dict(tool_name='tool0'), action_id = 0))
# Set work object
actions.append(Action('SetWorkObject', dict(wobj_name='wobj0'), action_id = 1))

id = 1

for i in range(len(all_place_sequence)):
    
    frames_place = []
    frames_pick = []
    
    #close gripper
    id +=1
    actions.append(Action('SetDigital', dict(io_name = 'ABB_Scalable_IO_0_DO16', value = 0), action_id = id))
    id +=1
    actions.append(Action('PrintText', dict(text='Gripper is off'), action_id = id))
    
    #send the place sequence
    for plane_place in all_place_sequence[i]:
        frame_place = RhinoPlane.from_geometry(plane_place).to_compas_frame()
        scaled_frame_place = frame_place.transformed(S)
        id +=1
        actions.append(Action('MoveToFrame', dict(frame= scaled_frame_place, speed=speed, zone=rrc.Zone.FINE, motion_type='rrc.Motion.LINEAR', feedback_level=2), action_id = id))
    
    #open gripper
    id +=1
    actions.append(Action('SetDigital', dict(io_name = 'ABB_Scalable_IO_0_DO16', value = 0), action_id = id))
    id +=1
    actions.append(Action('PrintText', dict(text='Gripper is on'), action_id = id))
    
    #send the pick sequence
    for plane_pick in (all_pick_sequence[i]):
        frame_pick = RhinoPlane.from_geometry(plane_pick).to_compas_frame()
        scaled_frame_pick = frame_pick.transformed(S)
        id +=1
        actions.append(Action('MoveToFrame', dict(frame= scaled_frame_pick, speed=speed, zone=rrc.Zone.FINE, motion_type='rrc.Motion.LINEAR',feedback_level=2), action_id = id))
        
        
    print id
print('Generated JSON file: {}'.format(file_path, pretty=True))
print actions
production_data = ProductionData(actions)

if export:
    with open(file_path, 'w') as fp:
        compas.json_dump(production_data.to_data(), fp)
# ---------- end send ----------

# ---- group: forward kinematics
# Forward Kinematics
load_presets = Button()
jp = GhPythonScript()  # -> all_joint_value_zero
# ---------- jp: Python ----------
import math
all_joint_value_zero = [0] * 6
print all_joint_value_zero
# ---------- end jp ----------
a1 = Slider(-22, range=-180..180)
a2 = Slider(0, range=-360..360)
a3 = Slider(0, range=-360..360)
a5 = Slider(0, range=-360..360)
a6 = Slider(0, range=-360..360)
a4 = Slider(0, range=-360..360)
forward_kinematics = PythonScript(robot=tool, set_joint_positions=load_presets, joint_positions=jp, a1=a1, a2=a2, a3=a3, a4=a4, a5=a5, a6=a6)  # -> full_configuration; inputs joint_positions: list
# ---------- forward_kinematics: Python ----------
import math
import Grasshopper
from compas.robots import Joint
from compas_fab.robots import Configuration

if set_joint_positions:

    j = 0
    for i in range(ghenv.Component.Params.Input.Count):
        nslider = ghenv.Component.Params.Input[i].Sources[0]
        if nslider.GetType() == Grasshopper.Kernel.Special.GH_NumberSlider:
            nslider.TrySetSliderValue(joint_positions[j])
            j += 1

if robot:
    joint_positions = [a1, a2, a3, a4, a5, a6]
    joint_types = robot.get_configurable_joint_types()
    for i, joint_type in enumerate(joint_types):
        if joint_type == Joint.REVOLUTE:
            joint_positions[i] = math.radians(joint_positions[i])
    full_configuration = Configuration(joint_positions, joint_types)
# ---------- end forward_kinematics ----------

# ----
jp_2 = GhPythonScript()  # -> packing_joint_values
# ---------- jp_2: Python ----------
import math
packing_joint_values = [0, 0, 85, 0, 0, 0]
print packing_joint_values
# ---------- end jp_2 ----------
jp_3 = GhPythonScript()  # -> home_vertical_joint_values
# ---------- jp_3: Python ----------
import math
home_vertical_joint_values = [0, 0, 0, 0, 90, -45]
print home_vertical_joint_values
# ---------- end jp_3 ----------
item = ListItem(List=place_planes, Index=number_slider, Wrap=True)
item_2 = ListItem(List=brep_2, Index=number_slider, Wrap=True)

# ---- group: Simulation from MoveIt
# Inverse Kinematics
zero_config = ZeroConfig(robot=tool)  # -> config
#   port group: If assigned, it will return the zero configuration for the given group, otherwise a full zero configuration.
#   port config: The zero configuration.
# ---------- zero_config: Python ----------
"""
Get a zero configuration for a robot.

COMPAS FAB v0.27.0
"""
from ghpythonlib.componentbase import executingcomponent as component


class ConfigZero(component):
    def RunScript(self, robot, group):

        if robot:
            return robot.zero_configuration(group)

        return None
# ---------- end zero_config ----------
ik = InverseKinematics(robot=tool, plane=item, start_configuration=zero_config)  # -> configuration
#   port plane: The plane or frame to calculate the inverse kinematic for.
#   port start_configuration: If passed, calculates the inverse such that the joint positions differ the least from the start_configuration. Defaults to the zero configuration.
#   port group: The planning group used for calculation. Defaults to the robot's main planning group.
#   port configuration: The planning group's configuration.
# ---------- ik: Python ----------
"""
Calculate the robot's inverse kinematic for a given plane.

COMPAS FAB v0.27.0
"""
from compas_rhino.conversions import RhinoPlane
from compas.geometry import Frame
from ghpythonlib.componentbase import executingcomponent as component


class InverseKinematics(component):
    def RunScript(self, robot, plane, start_configuration, group):
        configuration = None
        if robot and robot.client and robot.client.is_connected and plane:
            frame = RhinoPlane.from_geometry(plane).to_compas_frame()
            configuration = robot.inverse_kinematics(frame, start_configuration, group, options={
                                                    'avoid_collisions':False,
                                                    'return_full_configuration':True,
                                                  })     
        return configuration
# ---------- end ik ----------

# ----
show_end_effector_frame = BooleanToggle(True)
show_base_frame = BooleanToggle(False)
show_frames = BooleanToggle(True)

# ----
# Draw robot
list_3 = ValueList({"Forward Kinematics": 0, "Inverse Kinematics": 1}, selected="Inverse Kinematics")
entwine = Entwine(Branch00=forward_kinematics, Branch01=ik, FlattenInputs=True)  # -> simplify(Result)
path = ConstructPath(Indices=list_3)
branch = TreeBranch(Tree=entwine, Path=path, MaintainPaths=True)
robot_visualize = RobotVisualize(
    robot=tool,
    configuration=branch,
    show_frames=show_frames,
    show_base_frame=show_base_frame,
    show_end_effector_frame=show_end_effector_frame)  # -> visual, collision, collision_meshes, attached_meshes, frames, base_frame, ee_frame; inputs show_visual: Boolean, show_collision: Boolean, show_frames: Boolean, show_base_frame: Boolean, show_end_effector_frame: Boolean, show_cm: Boolean, show_acm: Boolean
#   port group: The planning group used for end-effector and base visualization.
#   port configuration: The robot's full configuration.
#   port show_visual: Whether or not to show the robot's visual meshes.
#   port show_collision: Whether or not to show the robot's collision meshes.
#   port show_frames: Whether or not to show the robot's joint frames.
#   port show_base_frame: Whether or not to show the robot's base frame.
#   port show_end_effector_frame: Whether or not to show the robot's end-effector frame.
#   port show_cm: Whether or not to show the collision meshes (if any).
#   port show_acm: Whether or not to show the attached collision meshes (if any).
#   port visual: Rhino meshes of the robot's visual geometry (if any).
#   port collision: Rhino meshes of the robot's collision geometry (if any).
#   port collision_meshes: Rhino meshes of the scene's collision meshes (if any).
#   port attached_meshes: Rhino meshes of the scene's attached collision meshes (if any).
#   port frames: The robot's joint frames as Rhino planes (if any).
#   port base_frame: The robot's base frame as a Rhino plane (if any).
#   port ee_frame: The robot's end-effector frame as a Rhino plane (if any).
# ---------- robot_visualize: Python ----------
"""
Visualizes the robot.

COMPAS FAB v0.27.0
"""
from compas.artists import Artist
from compas.geometry import Frame
from compas.geometry import Transformation
from compas_fab.robots import PlanningScene
from ghpythonlib.componentbase import executingcomponent as component


class RobotVisualize(component):
    def RunScript(
        self,
        robot,
        group,
        configuration,
        show_visual,
        show_collision,
        show_frames,
        show_base_frame,
        show_end_effector_frame,
        show_cm,
        show_acm,
    ):

        visual = None
        collision = None
        collision_meshes = None
        attached_meshes = None
        frames = None
        base_frame = None
        ee_frame = None

        if robot:
            show_visual = True if show_visual is None else show_visual
            show_cm = True if show_cm is None else show_cm
            show_acm = True if show_acm is None else show_acm
            configuration = configuration or robot.zero_configuration()

            robot.update(configuration, visual=show_visual, collision=show_collision)
            compas_frames = robot.transformed_frames(configuration, group)

            if show_visual:
                visual = robot.artist.draw_visual()

            if show_collision:
                collision = robot.artist.draw_collision()

            if show_base_frame:
                base_compas_frame = compas_frames[0]
                artist = Artist(base_compas_frame)
                base_frame = artist.draw()

            if show_end_effector_frame:
                ee_compas_frame = robot.forward_kinematics(
                    configuration, group, options=dict(solver="model")
                )
                artist = Artist(ee_compas_frame)
                ee_frame = artist.draw()

            if show_frames:
                frames = []
                for compas_frame in compas_frames[1:]:
                    artist = Artist(compas_frame)
                    frame = artist.draw()
                    frames.append(frame)

            if show_cm or show_acm:
                scene = PlanningScene(robot)
                scene = robot.client.get_planning_scene()

                collision_meshes = []
                attached_meshes = []

                if show_cm:
                    for co in scene.world.collision_objects:
                        header = co.header
                        frame_id = header.frame_id
                        cms = co.to_collision_meshes()

                        for cm in cms:
                            if cm.frame != Frame.worldXY():
                                t = Transformation.from_frame(cm.frame)
                                mesh = cm.mesh.transformed(t)
                            else:
                                mesh = cm.mesh

                            collision_meshes.append(Artist(mesh).draw())

                if show_acm:
                    for aco in scene.robot_state.attached_collision_objects:
                        for acm in aco.to_attached_collision_meshes():
                            frame_id = aco.object["header"]["frame_id"]
                            frame = robot.forward_kinematics(
                                configuration, options=dict(link=frame_id)
                            )
                            t = Transformation.from_frame(frame)

                            # Local CM frame
                            if (
                                acm.collision_mesh.frame
                                and acm.collision_mesh.frame != Frame.worldXY()
                            ):
                                t = t * Transformation.from_frame(
                                    acm.collision_mesh.frame
                                )

                            mesh = acm.collision_mesh.mesh.transformed(t)

                            attached_meshes.append(Artist(mesh).draw())

        return (
            visual,
            collision,
            collision_meshes,
            attached_meshes,
            frames,
            base_frame,
            ee_frame,
        )
# ---------- end robot_visualize ----------
draw = GhPythonScript(frames=[robot_visualize.ee_frame, robot_visualize.base_frame, robot_visualize.frames], scale=Slider(0.2, range=0..1))  # -> P, V, C, W; inputs frames: list
# ---------- draw: Python ----------
from System.Drawing import Color
from compas_ghpython.artists import FrameArtist

red = Color.FromArgb(255, 0, 0)
green = Color.FromArgb(0, 255, 0)
blue = Color.FromArgb(0, 0, 255)

P = []
V = []
C = []

scale = float(scale)

for plane in frames:
    if not plane:
        continue
    P += [plane.Origin] * 3
    V.append(plane.XAxis * scale)
    V.append(plane.YAxis * scale)
    V.append(plane.ZAxis * scale)
    C += [red, green, blue]

W = 3
# ---------- end draw ----------
vdisex = VectorDisplayEx(Point=draw.P, Vector=draw.V, Colour=draw.C, Width=draw.W)

# ----
# Robot
# control
number_slider_2 = Slider(300, range=0..300)
ros_client = Data(ros.ros_client)

# ----
# Send to Robot
send_2 = GhPythonScript(
    run=run,
    send_elements=list,
    current_key=idx,
    all_pick_sequence=sequence.all_pick_sequence,
    all_place_sequence=sequence.all_place_sequence,
    ros=ros_client,
    speed=number_slider_2)  # inputs current_key: Int32, all_pick_sequence: tree of Plane, all_place_sequence: tree of Plane
# ---------- send_2: Python ----------
from compas_rhino.conversions import RhinoPlane, RhinoMesh
from compas.geometry import Scale, Frame
from compas_fab.robots import Robot
from compas_ghpython.utilities import ghtree_to_list
import compas_rrc as rrc
import time


all_pick_sequence = ghtree_to_list(all_pick_sequence)[0]
all_place_sequence = ghtree_to_list(all_place_sequence)[0]

if send_elements == "current":
    all_pick_sequence = list([all_pick_sequence[current_key]])
    all_place_sequence = list([all_place_sequence[current_key]])

abb = rrc.AbbClient(ros, '/rob1')
print('Connected.')

scalefactor = 1000
S = Scale.from_factors([scalefactor] * 3)

if run:
    # Set tool
    abb.send(rrc.SetTool('tool0'))
    # Set work object
    abb.send(rrc.SetWorkObject('wobj0'))
    print("in_run")
    
    for i in range(len(all_place_sequence)):
        
        frames_place = []
        frames_pick = []
        
        #close gripper
        abb.send_and_wait(rrc.SetDigital('ABB_Scalable_IO_0_DO16', 0), timeout=5)
        abb.send_and_wait(rrc.WaitTime(1))
        
        #send the place sequence
        for plane_place in all_place_sequence[i]:
            frame_place = RhinoPlane.from_geometry(plane_place).to_compas_frame()
            scaled_frame_place = frame_place.transformed(S)
            print scaled_frame_place
            abb.send_and_wait(rrc.MoveToFrame(scaled_frame_place, speed, rrc.Zone.FINE, rrc.Motion.LINEAR), timeout=10)
        
        #open gripper
        abb.send_and_wait(rrc.SetDigital('ABB_Scalable_IO_0_DO16', 1), timeout=5)
        
        #send the pick sequence
        for plane_pick in all_pick_sequence[i]:
            frame_pick = RhinoPlane.from_geometry(plane_pick).to_compas_frame()
            scaled_frame_pick = frame_pick.transformed(S)
            abb.send_and_wait(rrc.MoveToFrame(scaled_frame_pick, speed, rrc.Zone.FINE, rrc.Motion.LINEAR), timeout=10)
# ---------- end send_2 ----------

# ----
# Send frame
run_2 = Button()
send_frame = GhPythonScript(ros=ros_client, run=run_2, speed=number_slider_2)  # inputs planes: list
# ---------- send_frame: Python ----------
from compas_rhino.conversions import RhinoPlane
from compas.geometry import Scale

import compas_rrc as rrc

abb = rrc.AbbClient(ros, '/rob1')
print('Connected.')

frames = []

scalefactor = 1000
S = Scale.from_factors([scalefactor] * 3)

if run: 
    for plane in planes :
        frame = RhinoPlane.from_geometry(plane).to_compas_frame()
        scaled_frame = frame.transformed(S)
        frames.append(scaled_frame)
    
    # Set tool
    abb.send(rrc.SetTool('t_gripper'))

    # Set work object
    abb.send(rrc.SetWorkObject('wobj0'))
    
    for frame in frames: 
        abb.send_and_wait(rrc.MoveToFrame(frame, speed, rrc.Zone.FINE, rrc.Motion.LINEAR), timeout=10)
# ---------- end send_frame ----------

# ----
# Get frame and joint values
run_3 = Button()
get_frame_joints = GhPythonScript(ros=ros_client, run=run_3)  # -> frame, joints
# ---------- get_frame_joints: Python ----------
import compas_rrc as rrc
abb = rrc.AbbClient(ros, '/rob1')
print('Connected.')

if run: 
    # Set tool
    abb.send(rrc.SetTool('tool0'))
    
    # Set work object
    abb.send(rrc.SetWorkObject('wobj0'))
    
    # Read current frame position
    frame = abb.send_and_wait(rrc.GetFrame(), timeout = 10)
    print("frame: ", frame)
    
    # Read current Configuration
    joints = abb.send_and_wait(rrc.GetJoints(), timeout = 10)
    print("joints: ", joints)
# ---------- end get_frame_joints ----------
cluster = Cluster(rec=get_frame_joints.frame, rec_2=get_frame_joints.joints)  # -> plane, configuration_2
panel_4 = Panel(cluster.plane)
panel_5 = Panel(cluster.configuration_2)

# ----
# Gripper on/off
open = Button()
close = Button()
gripper = GhPythonScript(ros=ros_client, open=open, close=close)  # inputs open: Boolean
# ---------- gripper: Python ----------
import compas_rrc as rrc
abb = rrc.AbbClient(ros, '/rob1')
print('Connected.')

if open : 
    abb.send(rrc.SetDigital('ABB_Scalable_IO_0_DO16', 1))
    
if close : 
    abb.send(rrc.SetDigital('ABB_Scalable_IO_0_DO16', 0))
# ---------- end gripper ----------

# ----
# Send joint values
run_4 = Button()
send_joints = GhPythonScript(configuration=branch, ros=ros_client, run=run_4, speed=number_slider_2)
# ---------- send_joints: Python ----------
import compas_rrc as rrc
import math
abb = rrc.AbbClient(ros, '/rob1')
print('Connected.')

#external_axes = [0,0,0,0,0,0]
external_axes = []

if run : 
    robot_joints = [math.degrees(jv) for jv in configuration.joint_values]
    print("robot_joints =", robot_joints)
    abb.send_and_wait(rrc.MoveToJoints(robot_joints, external_axes, speed, rrc.Zone.Z10), timeout = 10)
# ---------- end send_joints ----------

# ----
# Send text to flexpendant
run_5 = Button()
send_text = GhPythonScript(message="Hello LE.AR.N!", ros=ros_client, run=run_5)
# ---------- send_text: Python ----------
import compas_rrc as rrc
abb = rrc.AbbClient(ros, '/rob1')
print('Connected.')

if run : 
    abb.send_and_wait(rrc.PrintText(message), timeout = 10)
# ---------- end send_text ----------

# ==== cluster Cluster
rec = ClusterInput()
rec_2 = ClusterInput()
rec_3 = DataRecorder(rec, DataLimit=-10, RecordData=True)
rec_4 = DataRecorder(simplify(flatten(rec_2)), DataLimit=-10, RecordData=True)
clean = CleanTree(RemoveNulls=True, RemoveInvalid=True, RemoveEmpty=False, Tree=flatten(rec_4))
clean_2 = CleanTree(RemoveNulls=True, RemoveInvalid=True, RemoveEmpty=False, Tree=rec_3)
item = ListItem(List=clean, Index="-1", Wrap=True)
item_2 = ListItem(List=clean_2, Index="-1", Wrap=True)
draw = Draw(cg=item_2)  # -> rg
#   port cg: The COMPAS geometry or datastructure to be drawn.
#   port rg: The Rhino geometry object.
# ---------- draw: Python ----------
"""
Draws COMPAS geometry in Grasshopper.
"""
from ghpythonlib.componentbase import executingcomponent as component

from compas.artists import Artist


class CompasToRhinoGeometry(component):
    def RunScript(self, cg):
        if not cg:
            return None

        return Artist(cg).draw()
# ---------- end draw ----------
configuration = Data(item)
python = GhPythonScript(frame=item_2)  # -> out, plane
# ---------- python: Python ----------
import compas_rhino.conversions
import compas.artists
import compas_ghpython as cp

plane = cp.draw_frame(frame)
# ---------- end python ----------
configuration_2 = ClusterOutput(configuration)
plane = ClusterOutput(draw)
